# Grasshopper definition DAY_1_INTRO_LISTS.gh (Grasshopper 0.9.76)

# ---- group: LIST TUTORIAL
number_slider = Slider(9, range=0..10)  # disabled
number_slider_2 = Slider(0, range=0..100)  # disabled
number_slider_3 = Slider(10, range=0..10)  # disabled
number_slider_4 = Slider(1, range=0..10)  # disabled
construct_domain = ConstructDomain(DomainStart=number_slider_2, DomainEnd=number_slider)  # disabled
random = Random(Range=construct_domain, Number=number_slider_4, Seed=number_slider_3, Integers=True)  # disabled
ciee___spring_2016 = Panel("""andrew
aria
crystal
aaron
raquel
adrienne
melissa
sarah
dakota
tricia""")  # disabled
list_item = ListItem(List=ciee___spring_2016, Index=random, Wrap=True)  # disabled
panel = Panel(list_item)  # disabled

# ---- group: EXERCISE 2
construct_point = ConstructPoint(XCoordinate=0, YCoordinate=0, ZCoordinate=0)  # disabled
number_slider_5 = Slider(4, range=0..10)  # disabled
series = Series(Start=0, Step=number_slider_5, Count=10)  # disabled
panel_2 = Panel(series)  # disabled
unit_x = UnitX(Factor=panel_2)  # disabled
move = Move(Geometry=construct_point, Motion=unit_x)  # -> Geometry, Transform; disabled
number_slider_6 = Slider(2, range=0..10)  # disabled
circle = Circle(Plane=move.Geometry, Radius=number_slider_6)  # disabled

# ---- group: EXERCISE 6
curve = Curve(<curve referenced from the Rhino model>)  # disabled
divide_curve = DivideCurve(Curve=curve, Count=10, Kinks=False)  # -> Points, Tangents, Parameters; disabled
panel_3 = Panel("""true
false""")  # disabled
dispatch = Dispatch(List=divide_curve.Points, DispatchPattern=panel_3)  # -> ListA, ListB; disabled
point = Point(dispatch.ListB)  # disabled
point_2 = Point(dispatch.ListA)  # disabled
deconstruct = Deconstruct(Point=point_2)  # -> XComponent, YComponent, ZComponent; disabled
number_slider_7 = Slider(5, range=0..10)  # disabled
construct_point_2 = ConstructPoint(XCoordinate=deconstruct.XComponent, YCoordinate=deconstruct.YComponent, ZCoordinate=number_slider_7)  # disabled
weave = Weave(Pattern=panel_3, Stream0=point, Stream1=construct_point_2, NullGaps=False)  # disabled
interpolate = Interpolate(Vertices=weave, Degree=3, Periodic=False, KnotStyle=1)  # -> Curve, Length, Domain; disabled

# ----
point_3 = Point(<point referenced from the Rhino model>)  # disabled
point_4 = Point(<point referenced from the Rhino model>)  # disabled
number_slider_8 = Slider(4, range=0..10)  # disabled
point_5 = Point(<point referenced from the Rhino model>)  # disabled
point_6 = Point(<point referenced from the Rhino model>)  # disabled
point_7 = Point(<point referenced from the Rhino model>)  # disabled
circle_2 = Circle(Plane=point_5, Radius=number_slider_8)  # disabled
circle_3 = Circle(Plane=point_4, Radius=number_slider_8)  # disabled
circle_4 = Circle(Plane=point_3, Radius=number_slider_8)  # disabled
circle_5 = Circle(Plane=point_6, Radius=number_slider_8)  # disabled
circle_6 = Circle(Plane=point_7, Radius=number_slider_8)  # disabled

square = Square(Plane=PlaneXY(0, 0, 0), Size=Slider(10, range=0..10), ExtentX=5, ExtentY=5)  # -> Cells, Points
series_2 = Series(Start=0, Step=Slider(10, range=0..10), Count=Slider(6, range=0..10))
point_8 = Point(square.Points)
curve_2 = Curve(square.Cells)
unit_z = UnitZ(Factor=series_2)
panel_4 = Panel(point_8)
flatten_tree = FlattenTree(Tree=point_8, Path="{0}")
graft_tree = GraftTree(Tree=unit_z, IncludeEmptyLists=True, IncludeNullItems=True)
curve_3 = Curve(<curve referenced from the Rhino model>)
move_2 = Move(Geometry=flatten_tree, Motion=graft_tree)  # -> flatten(Geometry), Transform
evaluate_curve = EvaluateCurve(Curve=reparameterize(curve_3), Parameter=Slider(0.1, range=0..1))  # -> Point, Tangent, Angle
number_slider_9 = Slider(5, range=0..10)
point_9 = Point(evaluate_curve.Point)
distance = Distance(PointA=point_9, PointB=move_2.Geometry)
center_box = CenterBox(Base=move_2.Geometry, X=number_slider_9, Y=number_slider_9, Z=number_slider_9)
panel_5 = Panel(distance)
construct_domain_2 = ConstructDomain(DomainStart=Slider(0.1, range=0..1), DomainEnd=Slider(1, range=0..1))
bounds = Bounds(Numbers=panel_5)
remap_numbers = RemapNumbers(Value=panel_5, Source=bounds, Target=construct_domain_2)  # -> Mapped, Clipped
panel_6 = Panel(bounds)
bounds_2 = Bounds(Numbers=remap_numbers.Mapped)
scale = Scale(Geometry=center_box, Center=move_2.Geometry, Factor=remap_numbers.Mapped)  # -> Geometry, Transform
panel_7 = Panel(bounds_2)

point_10 = Point([<point referenced from the Rhino model> x5])  # disabled
number_slider_10 = Slider(4, range=0..4)  # disabled
circle_7 = Circle(Plane=point_10, Radius=number_slider_10)  # disabled

number_slider_11 = Slider(1, range=0..1)  # disabled
number_slider_12 = Slider(1, range=0..1)  # disabled
number_slider_13 = Slider(10, range=0..10)  # disabled
number_slider_14 = Slider(100, range=0..100)  # disabled
number_slider_15 = Slider(1000, range=0..1000)  # disabled
number_slider_16 = Slider(4.1, range=0.1..10.5)  # disabled
number_slider_17 = Slider(8, range=2..8)  # disabled

# ---- group: EXERCISE 1
number_slider_18 = Slider(4, range=0..10)  # disabled
construct_point_3 = ConstructPoint(XCoordinate=0, YCoordinate=0, ZCoordinate=0)  # disabled
circle_8 = Circle(Plane=construct_point_3, Radius=1)  # disabled
construct_point_4 = ConstructPoint(XCoordinate=number_slider_18, YCoordinate=0, ZCoordinate=0)  # disabled
number_slider_19 = Slider(8, range=0..10)  # disabled
circle_9 = Circle(Plane=construct_point_4, Radius=1)  # disabled
construct_point_5 = ConstructPoint(XCoordinate=number_slider_19, YCoordinate=0, ZCoordinate=0)  # disabled
number_slider_20 = Slider(16, range=0..100)  # disabled
circle_10 = Circle(Plane=construct_point_5, Radius=1)  # disabled
construct_point_6 = ConstructPoint(XCoordinate=number_slider_20, YCoordinate=0, ZCoordinate=0)  # disabled
number_slider_21 = Slider(20, range=0..100)  # disabled
circle_11 = Circle(Plane=construct_point_6, Radius=1)  # disabled
construct_point_7 = ConstructPoint(XCoordinate=number_slider_21, YCoordinate=0, ZCoordinate=0)  # disabled
circle_12 = Circle(Plane=construct_point_7, Radius=1)  # disabled

# ----
number_slider_22 = Slider(4, range=0..100)  # disabled

# ---- group: EXERCISE 3
number_slider_23 = Slider(1, range=0..1)  # disabled
number_slider_24 = Slider(32, range=0..100)  # disabled
number_slider_25 = Slider(10, range=0..10)  # disabled
construct_domain_3 = ConstructDomain(DomainStart=number_slider_23, DomainEnd=number_slider_24)  # disabled
construct_point_8 = ConstructPoint(XCoordinate=0, YCoordinate=0, ZCoordinate=0)  # disabled
random_2 = Random(Range=construct_domain_3, Number=number_slider_25, Seed=number_slider_22)  # disabled
unit_x_2 = UnitX(Factor=random_2)  # disabled
move_3 = Move(Geometry=construct_point_8, Motion=unit_x_2)  # -> Geometry, Transform; disabled
number_slider_26 = Slider(2, range=0..10)  # disabled
circle_13 = Circle(Plane=move_3.Geometry, Radius=number_slider_26)  # disabled

# ---- group: EXERCISE 4
number_slider_27 = Slider(4, range=0..10)  # disabled
construct_point_9 = ConstructPoint(XCoordinate=0, YCoordinate=0, ZCoordinate=0)  # disabled
series_3 = Series(Start=0, Step=number_slider_27, Count=10)  # disabled
panel_8 = Panel(series_3)  # disabled
unit_x_3 = UnitX(Factor=panel_8)  # disabled
move_4 = Move(Geometry=construct_point_9, Motion=unit_x_3)  # -> Geometry, Transform; disabled
number_slider_28 = Slider(2, range=0..10)  # disabled
circle_14 = Circle(Plane=move_4.Geometry, Radius=number_slider_28)  # disabled
number_slider_29 = Slider(3, range=0..10)  # disabled
panel_9 = Panel(random_2)  # disabled
panel_10 = Panel(circle_14)  # disabled
cull_index = CullIndex(List=circle_14, Indices=number_slider_29, Wrap=True)  # disabled
list_item_2 = ListItem(List=circle_14, Index=number_slider_29, Wrap=True)  # disabled
panel_11 = Panel(list_item_2)  # disabled
boundary_surfaces = BoundarySurfaces(Edges=list_item_2)  # disabled
shift_list = ShiftList(List=panel_9, Shift=1, Wrap=True)  # disabled
panel_12 = Panel(shift_list)  # disabled
panel_13 = Panel(cull_index)  # disabled
unit_z_2 = UnitZ(Factor=1)  # disabled

# ---- group: LIST TUTORIAL / LIST ITEM
number_slider_30 = Slider(6, range=0..10)  # disabled
list_item_3 = ListItem(List=ciee___spring_2016, Index=random, Wrap=True)  # disabled
panel_14 = Panel(list_item_3)  # disabled

# ---- group: LIST TUTORIAL / PARTITION LIST
panel_15 = Panel("""3
3
4""")  # disabled
partition_list = PartitionList(List=ciee___spring_2016, Size=panel_15)  # disabled
panel_16 = Panel(partition_list)  # disabled

# ---- group: LIST TUTORIAL
panel_17 = Panel(ciee___spring_2016)  # disabled
number_slider_31 = Slider(4, range=0..10)  # disabled
split_list = SplitList(List=panel_17, Index=number_slider_31)  # -> ListA, ListB; disabled
panel_18 = Panel(split_list.ListA)  # disabled
panel_19 = Panel(split_list.ListB)  # disabled

panel_20 = Panel(ciee___spring_2016)  # disabled
boolean_toggle = BooleanToggle(False)  # disabled
number_slider_32 = Slider(1, range=0..10)  # disabled
shift_list_2 = ShiftList(List=panel_20, Shift=number_slider_32, Wrap=boolean_toggle)  # disabled
panel_21 = Panel(shift_list_2)  # disabled

# ---- group: LIST TUTORIAL / SORT LIST
panel_22 = Panel(random_2)  # disabled
sort_list = SortList(Keys=panel_22)  # -> Keys, ValuesValuesA; disabled
panel_23 = Panel(sort_list.Keys)  # disabled

# ---- group: LIST TUTORIAL
panel_24 = Panel(ciee___spring_2016)  # disabled
reverse_list = ReverseList(List=panel_24)  # disabled
panel_25 = Panel(reverse_list)  # disabled

list_length = ListLength(List=ciee___spring_2016)  # disabled
panel_26 = Panel(list_length)  # disabled

# ---- group: LIST TUTORIAL / CULL INDEX
cull_index_2 = CullIndex(List=ciee___spring_2016, Indices=random, Wrap=True)  # disabled
panel_27 = Panel(cull_index_2)  # disabled

# ----
number_slider_33 = Slider(2, range=0..10)  # disabled
cull_index_3 = CullIndex(List=random_2, Indices=number_slider_33, Wrap=True)  # disabled
unit_z_3 = UnitZ(Factor=cull_index_3)  # disabled
move_5 = Move(Geometry=cull_index, Motion=unit_z_3)  # -> Geometry, Transform; disabled
graft_tree_2 = GraftTree(Tree=cull_index, IncludeEmptyLists=True, IncludeNullItems=True)  # disabled
graft_tree_3 = GraftTree(Tree=move_5.Geometry, IncludeEmptyLists=True, IncludeNullItems=True)  # disabled
loft = Loft(
    Curves=[graft_tree_3, graft_tree_2],
    Options={Adjust=False, Closed=False, LoftEnds=0, LoftSimp=0, LoftType=0, Rebuild=10, Refit=0.01})  # disabled

# ---- group: EXERCISE 7
number_slider_34 = Slider(30, range=0..100)  # disabled
bottom = Curve(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)  # disabled
top = Curve(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)  # disabled
divide_curve_2 = DivideCurve(Curve=bottom, Count=number_slider_34, Kinks=False)  # -> Points, Tangents, Parameters; disabled
divide_curve_3 = DivideCurve(Curve=top, Count=number_slider_34, Kinks=False)  # -> Points, Tangents, Parameters; disabled
number_slider_35 = Slider(20, range=0..100)  # disabled
shift_list_3 = ShiftList(List=divide_curve_3.Points, Shift=number_slider_35, Wrap=True)  # disabled
boolean_toggle_2 = BooleanToggle(True)  # disabled
loft_options = LoftOptions(Closed=boolean_toggle_2, Adjust=False, Rebuild=0, Refit=0, Type=0)  # disabled

panel_28 = Panel("""true
false""")  # disabled
dispatch_2 = Dispatch(List=divide_curve_2.Points, DispatchPattern=panel_28)  # -> ListA, ListB; disabled
deconstruct_2 = Deconstruct(Point=dispatch_2.ListB)  # -> XComponent, YComponent, ZComponent; disabled
number_slider_36 = Slider(7, range=0..10)  # disabled
construct_point_10 = ConstructPoint(XCoordinate=deconstruct_2.XComponent, YCoordinate=deconstruct_2.YComponent, ZCoordinate=number_slider_36)  # disabled
weave_2 = Weave(Pattern=panel_28, Stream0=construct_point_10, Stream1=dispatch_2.ListA, NullGaps=False)  # disabled

line = Line(StartPoint=shift_list_3, EndPoint=weave_2)  # disabled
loft_2 = Loft(Curves=line, Options=loft_options)  # disabled
