# Grasshopper definition DAY_2_GHOWL.gh (Grasshopper 0.9.76)
# plug-ins: gHowl

# ---- group: log file
path = FilePath("E:\Google Drive\_WORK\NERO\2016_02_NERO_COSTARICA\01-DOC GRAPHIC\DATA\LOGS\PINA Field-1st Flight\17.log")
file = ReadFile(File=path, PerLineParse=True)
tmatch = MatchText(Text=file, Pattern="POS,*", Case=True)
cull = CullPattern(List=file, CullPattern=tmatch)  # -> graft(List)
split = TextSplit(Text=cull, Separators=",")

longitude = Slider(4, range=0..10)
latitude = Slider(2, range=0..10)
longitude_2 = Slider(3, range=0..10)
item = ListItem(List=split, Index=latitude, Wrap=True)  # -> flatten(Item)
item_2 = ListItem(List=split, Index=longitude_2, Wrap=True)  # -> flatten(Item)
item_3 = ListItem(List=split, Index=longitude, Wrap=True)  # -> flatten(Item)
pt = ConstructPoint(XCoordinate=item_2, YCoordinate=item, ZCoordinate=item_3)

pt_2 = Point(<point referenced from the Rhino model>)
pt_3 = Point(<point referenced from the Rhino model>)
p1_lon_lat = Panel("{-83.587934,10.148902,0}")
p2_lon_lat = Panel("{-83.584286,10.151028,0}")
geo_xyz = GeoToXYZ(Geo_IN=pt, Pt1ReferenceXYZ=pt_2, Pt2ReferenceXYZ=pt_3, Pt1ReferenceGeo=p1_lon_lat, Pt2ReferenceGeo=p2_lon_lat)

# ----
pline = PolyLine(Vertices=geo_xyz, Closed=False)
divide = DivideCurve(Curve=pline, Count=Slider(165, range=0..1000), Kinks=False)  # -> Points, Tangents, Parameters
split_2 = SplitList(List=divide.Points, Index=Slider(1, range=1..165))  # -> ListA, ListB
item_4 = ListItem(List=divide.Points, Index=Slider(165, range=1..165), Wrap=True)
item_5 = ListItem(List=divide.Points, Index=Slider(111, range=0..1000), Wrap=True)
cloud = CloudDisplay(Points=split_2.ListB, Colours=ColourSwatch(SwatchColor=RGB(255, 255, 255)), Size=Slider(3, range=0..1000), SpriteType=0)
cloud_2 = CloudDisplay(Points=split_2.ListA, Colours=ColourSwatch(SwatchColor=RGB(255, 255, 255)), Size=Slider(5, range=0..1000), SpriteType=0)
dots = DotDisplay(Point=item_4, Colour=ColourSwatch(SwatchColor=RGB(255, 255, 255)), Size=Slider(3, range=0..1000))
