# Grasshopper definition DAY_05_STIGMERGY-00.gh (Grasshopper 0.9.76)
# Copyright: Co-de-iT
# plug-ins: Anemone, Human, Boid, Mesh Pipe

path = FilePath("E:\Google Drive\_WORK\IAAC\02_GLOBAL SUMMER SCHOOL\01-DOC GRAPHIC\VECTORIAL\3D\00_WIP\ALDO'S FILES\map.osm")
loc = Location(FilePText=path)  # -> OSMPointData, OSMData, LongitudeDomain, LatitudeDomain

# ----
# OPEN FIRST RHINO AND SET UNITS  IN METERS
# ELK - SCALE AND POSITION
panel = Panel(path)

minrds = MinorRoads(OSMPointData=loc.OSMPointData, OSMDataText=loc.OSMData, CollectionType=0)  # -> Residential, UnclassifiedRoads, NotClassified, FeatureKey
rail = Railways(OSMPointData=loc.OSMPointData, OSMDataText=loc.OSMData, CollectionType=0)  # -> Rail, Tram, LightRail, Subway, MonoRail, NarrowGauge, FeatureKey
genosm = GenericOSM(OSMPointData=loc.OSMPointData, OSMDataText=loc.OSMData, FeatureKey="building", FeatureValue="*", CollectionType=0)  # -> FeaturePoints, FeatureKey

pline = PolyLine(Vertices=minrds.Residential, Closed=False)
pline_2 = PolyLine(Vertices=rail.Rail, Closed=False)
pline_3 = PolyLine(Vertices=rail.Tram, Closed=False)
pline_4 = PolyLine(Vertices=rail.Subway, Closed=False)
pline_5 = PolyLine(Vertices=genosm.FeaturePoints, Closed=False)

group = Group(Objects=flatten(pline))
group_2 = Group(Objects=flatten(pline_2))
group_3 = Group(Objects=flatten(pline))
group_4 = Group(Objects=flatten(pline_4))
group_5 = Group(Objects=flatten(pline_5))
group_6 = Group(Objects=[group, group_2, group_3, group_4, group_5])

bbox = BoundingBox(Content=flatten(pline_5), Plane=PlaneXY(0, 0, 0), UnionBox=True)  # -> Box, Box_2
boxprop = BoxProperties(Box=bbox.Box)  # -> Center, Diagonal, Area, Volume, Degeneracy
scale = Scale(Geometry=group_6, Center=boxprop.Center, Factor=Slider(0.1, range=0..1))  # -> Geometry, Transform

bbox_2 = BoundingBox(Content=scale.Geometry, Plane=PlaneXY(0, 0, 0))  # -> Box, Box_2
boxprop_2 = BoxProperties(Box=bbox_2.Box)  # -> Center, Diagonal, Area, Volume, Degeneracy
vec2pt = Vector2Pt(PointA=boxprop_2.Center, PointB="0,0,0", Unitize=False)  # -> Vector, Length
move = Move(Geometry=scale.Geometry, Motion=vec2pt.Vector)  # -> Geometry, Transform

ungroup = Ungroup(Group=move.Geometry)
item = ListItem(List=ungroup, Index=Slider(4, range=0..10), Wrap=True)

# ---- group: steering
maxforce = Slider(0.772, range=0..1)
maxspeed = Slider(2, range=0..3)

# ---- group: stigmergy
futloc = Slider(5, range=0..5)
agent = Slider(70, range=0..100)
vision_rad = Slider(25, range=0..100)
vision_ang = Slider(90, range=0..90)
follow_tail = Slider(1, range=0..1)
number_slider = Slider(40, range=0..100)

# ----
# COLOR MESH - GENERATE TRACES
bbox_3 = BoundingBox(Content=item, Plane=PlaneXY(0, 0, 0), UnionBox=True)  # -> Box, Box_2
mesh_uv = MeshSurface(Surface=bbox_3.Box, UCount=Slider(120, range=0..120), VCount=Slider(81, range=0..100), Overhang=True, Equalize=False)
demesh = DeconstructMesh(Mesh=mesh_uv)  # -> Vertices, Faces, Colours, Normals
pt = Point(demesh.Vertices)

genes = GenePool(Decimals=2, Maximum=1, Minimum=0, Value=[0.3685886922, 0.6546748726, 0.08530149846, 0.7])
genes_2 = GenePool(Decimals=2, Maximum=1, Minimum=0, Value=[0.01055828948, 0.7752618449, 0.2246489642, 0.1332767532])
pt_2 = ConstructPoint(XCoordinate=genes_2, YCoordinate=genes, ZCoordinate=0)
evalsrf = EvaluateSurface(Surface=reparameterize(bbox_3.Box), Point=pt_2)  # -> Point, Normal, Frame

cp = ClosestPoint(Point=demesh.Vertices, Cloud=evalsrf.Point)  # -> ClosestPoint, CPIndex, Distance
bnd = Bounds(Numbers=cp.Distance)
dedomain = DeconstructDomain(Domain=bnd)  # -> Start, End
gradient = Gradient(
    LowerLimit=dedomain.Start,
    UpperLimit=dedomain.End,
    Parameter=cp.Distance,
    stops=[0: RGB(222, 222, 222), 0.502: RGB(0, 0, 0)])
conmesh = ConstructMesh(Vertices=demesh.Vertices, Faces=demesh.Faces, Colours=gradient)
cloud = CloudDisplay(Points=graft(pt), Colours=graft(gradient), Size=Slider(0.5, range=0..1), SpriteType=0)

edges = BrepEdges(Brep=bbox_3.Box)  # -> Naked, Interior, NonManifold
crv = Curve(edges.Naked)
join = JoinCurves(Curves=crv, Preserve=False)

Z = UnitZ(Factor=Slider(60, range=0..100))
move_2 = Move(Geometry=conmesh, Motion=Z)  # -> Geometry, Transform

area = Area(Geometry=join)  # -> Area, Centroid
scale_2 = Scale(Geometry=join, Center=area.Centroid, Factor=Slider(0.6, range=0..1))  # -> Geometry, Transform

rndvec = RandomVector(Number=agent, Unit=True, RandomSeed=2, AbsoluteMultiplier=1)
devec = DeconstructVector(Vector=rndvec)  # -> XComponent, YComponent, ZComponent
vec = VectorXYZ(XComponent=devec.XComponent, YComponent=devec.YComponent, ZComponent=devec.ZComponent)  # -> unitize(Vector), Length
pop2d = Populate2D(Region=scale_2.Geometry, Count=agent, Seed=2)
merge = Merge(Data1=simplify(graft(pop2d)), Data2=simplify(graft(vec.Vector)), Data3=simplify(graft(pop2d)))
group_7 = Group(Objects=merge)

exit = Button()
iterations = Slider(15, range=0..500)
button = Button()

loop_start = LoopStart(N=iterations, T=button, D0=group_7, D1=move_2.Geometry)  # -> port, Counter, Data, Data_2

panel_2 = Panel(loop_start.Counter)

ungroup_2 = Ungroup(Group=loop_start.Data)  # -> simplify(Objects)
split = SplitList(List=ungroup_2, Index=Slider(2, range=0..10))  # -> simplify(ListA), simplify(ListB)
item_2 = ListItem(List=split.ListA, Index=0, Wrap=True)  # -> Item, Item1

demesh_2 = DeconstructMesh(Mesh=loop_start.Data_2)  # -> Vertices, Faces, Colours, Normals

split_2 = SplitList(List=reverse(split.ListB), Index=Slider(5, range=0..10))  # -> ListA, ListB

cir = Circle(Plane=item_2.Item, Radius=vision_rad)

# ----
# read environment
# future location
# brightest
# darkest
amp = Amplitude(Vector=item_2.Item1, Amplitude=futloc)
move_3 = Move(Geometry=item_2.Item, Motion=amp)  # -> Geometry, Transform
samples = Slider(5, range=3..10)
cps = ClosestPoints(Point=move_3.Geometry, Cloud=demesh_2.Vertices, Count=samples)  # -> ClosestPoint, CPIndex, Distance
item_3 = ListItem(List=demesh_2.Colours, Index=cps.CPIndex, Wrap=True)
ahsv = SplitAHSV(Colour=item_3)  # -> Alpha, Hue, Saturation, Value
sort = SortList(Keys=ahsv.Value, ValuesA=cps.ClosestPoint, ValuesB=cps.CPIndex)  # -> simplify(Keys), ValuesA, ValuesB
item_4 = ListItem(List=simplify(sort.ValuesA), Index=0, Wrap=True)  # -> Item1, Item
vec2pt_2 = Vector2Pt(PointA=item_2.Item, PointB=item_4.Item, Unitize=False)  # -> Vector, Length

# ----
# write environment
samples_2 = Slider(10, range=3..10)
cps_2 = ClosestPoints(Point=item_2.Item, Cloud=demesh_2.Vertices, Count=samples_2)  # -> ClosestPoint, CPIndex, Distance
replace = ReplaceItems(
    List=flatten(demesh_2.Colours),
    Item=flatten(ColourSwatch(SwatchColor=RGB(252, 252, 252))),
    Indices=flatten(cps_2.CPIndex),
    Wrap=False)

lng = ListLength(List=split_2.ListA)
# stigmergy
vec_2 = Vector(Vector(0, 0, 0))
repeat = RepeatData(Data=vec_2, Length=lng)
rad = Radians(Degrees=vision_ang)
visible = FindVisibleAgents(
    AgentLocationPoint=item_2.Item,
    AgentMotionVector=item_2.Item1,
    LocationPointsOfTheFlock=flatten(split_2.ListA),
    FlockMotionVectors=flatten(repeat),
    SearchDistance=vision_rad,
    SearchAngle=rad)  # -> ListOfPoints, ListOfVectors, ListOfIndices
cluster = Cluster(
    agent_location=flatten(item_2.Item),
    agent_vector_global=unitize(flatten(item_2.Item1)),
    visible_tail=simplify(visible.ListOfPoints))  # -> graft(vector)
tail_intensity = Slider(0.486, range=0..1)
multiplication = Multiplication(A=item_2.Item1, B=Slider(0.3, range=0..1))
steer = Steer(vel=multiplication, des=cluster, maxv=maxspeed, maxf=follow_tail)  # -> simplify(acc)
multiplication_2 = Multiplication(A=steer, B=tail_intensity)

panel_3 = Panel(sort.Keys)
steer_2 = Steer(vel=item_2.Item1, des=vec2pt_2.Vector, maxv=maxspeed, maxf=maxforce)

addition = Addition(B=multiplication_2, C=steer_2)
trmvec = TrimVector(Vector=addition, LengthDomain=maxspeed)

move_4 = Move(Geometry=item_2.Item, Motion=trmvec)  # -> Geometry, Transform

merge_2 = Merge(Data1=simplify(split.ListB), Data2=simplify(move_4.Geometry))
merge_3 = Merge(Data1=simplify(move_4.Geometry), Data2=simplify(trmvec), Data3=simplify(merge_2))
group_8 = Group(Objects=merge_3)

conmesh_2 = ConstructMesh(Vertices=demesh_2.Vertices, Faces=demesh_2.Faces, Colours=flatten(replace))
loop_end = LoopEnd(
    port=loop_start.port,
    Exit=exit,
    Data=group_8,
    Data_2=conmesh_2,
    pausedState=False,
    state="Constant output",
    TimeOutVal=0)  # -> D0, flatten(D1)
dam = DataDam(DataA=loop_end.D0, BufferDelay=10000000, BufferMode=0)
ungroup_3 = Ungroup(Group=dam)
split_3 = SplitList(List=ungroup_3, Index=Slider(2, range=0..10))  # -> ListA, ListB
nurbs = NurbsCurve(Vertices=split_3.ListB, Degree=Slider(10, range=0..10), Periodic=False)  # -> flatten(Curve), Length, Domain

reb = RebuildCurve(Curve=nurbs.Curve, Count=Slider(190, range=0..1000), Tangents=Slider(5, range=0..10))

number_slider_2 = Slider(10, range=0..100)  # disabled
divide = DivideCurve(Curve=reb, Count=number_slider_2, Kinks=False)  # -> flatten(Points), Tangents, Parameters; disabled
bbox_4 = BoundingBox(Plane=PlaneXY(0, 0, 0), UnionBox=True)  # -> Box, Box_2; disabled
number_slider_3 = Slider(120, range=0..120)  # disabled
number_slider_4 = Slider(81, range=0..100)  # disabled
mesh_uv_2 = MeshSurface(Surface=bbox_3.Box, UCount=number_slider_3, VCount=number_slider_4, Overhang=True, Equalize=False)  # disabled
pt_3 = Point(divide.Points)  # disabled
demesh_3 = DeconstructMesh(Mesh=mesh_uv_2)  # -> Vertices, Faces, Colours, Normals; disabled
cp_2 = ClosestPoint(Point=demesh_3.Vertices, Cloud=pt_3)  # -> ClosestPoint, CPIndex, Distance; disabled
bnd_2 = Bounds(Numbers=cp_2.Distance)  # disabled
dedomain_2 = DeconstructDomain(Domain=bnd_2)  # -> Start, End; disabled
gradient_2 = Gradient(
    LowerLimit=dedomain_2.Start,
    UpperLimit=dedomain_2.End,
    Parameter=cp_2.Distance,
    stops=[0: RGB(255, 255, 255), 1: RGB(0, 0, 0)])  # disabled
number_slider_5 = Slider(0.7, range=0..1)  # disabled
pt_4 = Point(demesh_3.Vertices)  # disabled
cloud_2 = CloudDisplay(Points=graft(pt_4), Colours=graft(gradient_2), Size=number_slider_5, SpriteType=0)  # disabled

divide_2 = DivideCurve(Curve=reb, Count=Slider(20, range=0..100), Kinks=False)  # -> Points, Tangents, simplify(Parameters)
dom = ConstructDomain(DomainStart=Slider(1, range=0..10), DomainEnd=Slider(3, range=0..20))

partition = PartitionList(List=divide_2.Points, Size=Slider(5, range=0..10))  # -> simplify(Chunks)
series = Series(Start=0, Step=Slider(2, range=0..10), Count=Slider(5, range=0..10))
tstat = TreeStatistics(Tree=partition)  # -> Paths, Length, Count
long = LongestList(ListA=tstat.Paths, ListB=series, PaddingMode=4)  # -> ListA, graft(ListB)
match = MatchTree(Tree=long.ListB, Guide=partition)
pdecon = Deconstruct(Point=partition)  # -> XComponent, YComponent, ZComponent
pt_5 = ConstructPoint(XCoordinate=pdecon.XComponent, YCoordinate=pdecon.YComponent, ZCoordinate=match)
pshift = ShiftPaths(Data=pt_5, Offset=-1)
intcrv = Interpolate(Vertices=pshift, Degree=3, Periodic=False, KnotStyle=1)  # -> Curve, Length, Domain
panel_4 = Panel(intcrv.Curve)
mpipe = MeshPipe(Curve=intcrv.Curve, Radius=Slider(0.5, range=0..1), Accuracy=0.2, Rotation=0, Segments=10, Caps=2)

shatter = Shatter(Curve=intcrv.Curve, Parameters=divide_2.Parameters)  # -> simplify(Segments)

lng_2 = ListLength(List=shatter)  # -> flatten(Length)
item_5 = ListItem(List=lng_2, Index=0, Wrap=True)
round = Round(Number=item_5)  # -> Nearest, Floor, Ceiling; disabled
panel_5 = Panel("1")  # disabled
division = Division(A=panel_5, B=round.Ceiling)  # disabled
series_2 = Series(Start=0, Step=division, Count=round.Ceiling)  # disabled
graph = GraphMapper(
    series_2,
    x0=0,
    x1=1,
    y0=0,
    y1=1,
    container_name="Bezier",
    cpx=[0, 0.6374178529, 0.8142894506, 1],
    cpy=[0, 0.1260549426, 0.5961636305, 1])  # disabled
xyz = ColourXYZ(Alpha=1, X=graph, Y=graph, Z=graph)  # disabled

range = Range(Domain=Domain(0, 1), Steps=expr("x-1", item_5))
gradient_3 = Gradient(LowerLimit=0, UpperLimit=Slider(1, range=0..1), Parameter=range, stops=[0: RGB(255, 255, 255), 1: RGB(75, 107, 169)])
lng_3 = ListLength(List=gradient_3)
range_2 = Range(Domain=dom, Steps=expr("x-1", lng_3))
previewlw = CustomPreviewLineweights(Geometry=simplify(shatter), Shader=gradient_3, Thickness=range_2, Absolute=False)

# ==== cluster Steer
maxf = ClusterInput()
vel = ClusterInput()
maxv = ClusterInput()
des = ClusterInput()
amp = Amplitude(Vector=des, Amplitude=maxv)
subtraction = Subtraction(A=amp, B=vel)
multiplication = Multiplication(A=subtraction, B=maxf)
vlen = VectorLength(Vector=multiplication)
min = Minimum(A=vlen, B=maxv)
amp_2 = Amplitude(Vector=multiplication, Amplitude=min)
acc = ClusterOutput(amp_2)

# ==== cluster Cluster
agent_location = ClusterInput()
agent_vector_global = ClusterInput()
visible_tail = ClusterInput()
motion_vector = Vector(agent_vector_global)
# visible tail points for each agent
pt = Point(simplify(visible_tail))
pt_2 = Point(agent_location)
# get non-empty branches
clean = CleanTree(RemoveNulls=True, RemoveInvalid=True, RemoveEmpty=True, Tree=pt)  # -> simplify(Tree)
# get indices of non-empty branches
viewer = ParamViewer(clean)
dpath = DeconstructPath(Branch=viewer)  # -> flatten(Indices)
# corresponding agents for each
# non-empty branch
# corresponding velocity for each
# non-empty branch
branch = TreeBranch(Tree=simplify(graft(pt_2)), Path=viewer, MaintainPaths=True)
item = ListItem(List=motion_vector, Index=dpath, Wrap=True)
vec2pt = Vector2Pt(PointA=branch, PointB=clean, Unitize=False)  # -> Vector, Length; disabled
sort = SortList(Keys=vec2pt.Length, ValuesA=vec2pt.Vector, ValuesB=clean)  # -> Keys, ValuesA, ValuesB; disabled
# vector to closest point in tail
cp = ClosestPoint(Point=branch, Cloud=clean)  # -> ClosestPoint, CPIndex, Distance
vec2pt_2 = Vector2Pt(PointA=branch, PointB=cp.ClosestPoint, Unitize=False)  # -> Vector, Length

# ---- group: vec
item_2 = ListItem(List=sort.ValuesA, Index=0, Wrap=True)  # disabled

# ----
angle = Angle(VectorA=simplify(graft(item)), VectorB=vec2pt_2.Vector)  # -> Angle, Reflex
# angle between vectors
deg = Degrees(Radians=angle.Angle)
vlen = VectorLength(Vector=item)

# ----
# rotation axis
pl = PlaneNormal(Origin=branch, ZAxis=simplify(graft(item)))
pl_2 = PlaneNormal(Origin=branch, ZAxis=vec2pt_2.Vector)
ppx = PlanePlane(PlaneA=pl_2, PlaneB=pl)
# VERY small discrepancies
# between these two, but enough
# to make the system diverge
amp = Amplitude(Vector=vec2pt_2.Vector, Amplitude=simplify(graft(vlen)))  # -> flatten(Vector)
vrot = Rotate(Vector=simplify(graft(item)), Axis=ppx, Angle=degrees(deg))  # -> flatten(Vector)

replace = ReplaceItems(List=motion_vector, Item=vrot, Indices=dpath, Wrap=False)
vector = ClusterOutput(replace)
