# Grasshopper definition DAY_5_DISCRETE VARIABLES.gh (Grasshopper 0.9.76)
# plug-ins: Heteroptera, Anemone, Weaverbird, Mesh Pipe

# ---- group: DISCRETE STAR
# UNIT IN METERS
number_slider = Slider(1, range=0..10)
box = CenterBox(Base=PlaneXY(0, 0, 0), X=number_slider, Y=number_slider, Z=number_slider)
mbox = MeshBox(Base=box, XCount="2", YCount="2", ZCount="2")
wbjoin = WeaverbirdsJoinMeshesAndWeld(Mesh=mbox, Weld=Toggle(True))
volume = Volume(Geometry=box)  # -> Volume, Centroid
demesh = DeconstructMesh(Mesh=wbjoin)  # -> Vertices, Faces, Colours, Normals
ln = Line(StartPoint=volume.Centroid, EndPoint=demesh.Vertices)
vec = Vector(ln)

# ----
vdis = VectorDisplay(Anchor=volume.Centroid, Vector=demesh.Vertices)

# ---- group: FIELDS
crv = Curve(simplify(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))
divide = DivideCurve(Curve=crv, Count=Slider(26, range=0..33), Kinks=False)  # -> Points, Tangents, Parameters

pline = PolyLine(Vertices=divide.Points, Closed=False)
number_slider_2 = Slider(4, range=0..70)
explode = Explode(Curve=pline, Recursive=True)  # -> Segments, Vertices

crv_2 = Curve(explode.Segments)
mpipe = MeshPipe(Curve=crv_2, Radius=Slider(20, range=0..70), Accuracy=0.2, Rotation=0, Segments=number_slider_2, Caps=1)

bbox = BoundingBox(Content=mpipe, Plane=PlaneXY(0, 0, 0), UnionBox=False)  # -> graft(Box), Box_2

# ----
item = ListItem(List=flatten(bbox.Box), Index=0, Wrap=True)  # -> Item1, Item

# ---- group: FIELDS
pop3d = Populate3D(Region=bbox.Box, Count=Slider(1, range=0..10), Seed=1)  # -> simplify(Population)
pcharge = PointCharge(Point=simplify(pop3d), Charge=Slider(-0.737, range=-1..1), Decay=Slider(0.68, range=0..5), Bounds=simplify(bbox.Box))

# ----
area = Area(Geometry=item.Item1)  # -> Area, Centroid
scale = Scale(Geometry=item.Item1, Center=area.Centroid, Factor=Slider(0.2, range=0..1))  # -> Geometry, Transform

# ---- group: FIELDS
end = EndPoints(Curve=crv_2)  # -> Start, End
vec2pt = Vector2Pt(PointA=end.Start, PointB=end.End, Unitize=False)  # -> Vector, Length
neg = Negative(Value=Slider(0.6, range=0..1))
line = LineSDL(Start=end.Start, Direction=vec2pt.Vector, Length=neg)
fvector = VectorForce(Line=graft(line), Bounds=graft(bbox.Box))  # -> simplify(Field)

curvepoint = PointOnCurve(crv_2, parameter=0.671)
lng = ListLength(List=flatten(curvepoint))
rnd_vector = RandomVector(Number=lng, Length=Domain(1, 5))
pl = PlaneNormal(Origin=graft(curvepoint), ZAxis=graft(rnd_vector))
fspin = SpinForce(Plane=simplify(pl), Strength=1, Radius=Slider(9, range=0..100), Decay=Slider(2.7, range=0..5), Bounds=simplify(bbox.Box))

# ----
brep = Brep(scale.Geometry)
popgeo = PopulateGeometry(Geometry=brep, Count=Slider(100, range=0..100), Seed=Slider(20, range=0..100))

lng_2 = ListLength(List=popgeo)
rnd_vector_2 = RandomVector(Number=lng_2, Lenght="1.3", isflat=True)

pt = Point(simplify(popgeo))
vec_2 = Vector(simplify(rnd_vector_2))
pt_2 = Point(pt)

merge = Merge(Data1=simplify(graft(pt)), Data2=simplify(graft(vec_2)), Data3=simplify(graft(pt_2)))

group = Group(Objects=merge)

mergef = MergeFields(Fields=flatten([fvector, pcharge, fspin]))

loop_start = LoopStart(Repeat=Slider(200, range=0..1000), Trigger=Button(), Data=group)  # -> port, Counter, Data
panel = Panel(loop_start.Counter)

ungroup = Ungroup(Group=loop_start.Data)  # -> simplify(Objects)
split = SplitList(List=ungroup, Index="2")  # -> ListA, ListB
list_item = ListItem(List=split.ListA, Index=0, Wrap=True)  # -> Item, Item1, Item2

# ---- group: MERGE VECTOR FIELDS
pt_3 = Point(simplify(list_item.Item))
evf = EvaluateField(Field=mergef, Point=simplify(pt_3))  # -> Tensor, Strength

# ----
addition = Addition(A=evf.Tensor)

# ---- group: DISCRETIZATION APPLIED TO ALL AGENTS
angle = Angle(VectorA=addition, VectorB=vec)  # -> Angle, Reflex
sort = SortList(Keys=simplify(angle.Angle), ValuesA=vec)  # -> Keys, ValuesA
item_2 = ListItem(List=sort.ValuesA, Index=0, Wrap=True)  # -> simplify(Item)

# ----
sort_2 = SortList(Keys=simplify(angle.Angle), ValuesA=vec)  # -> Keys, ValuesA
vdis_2 = VectorDisplay(Anchor=pt_3, Vector=addition)
vdis_3 = VectorDisplay(Anchor=list_item.Item, Vector=item_2)

move = Move(Geometry=list_item.Item, Motion=item_2)  # -> Geometry, Transform
merge_2 = Merge(Data1=split.ListB, Data2=move.Geometry)
merge_3 = Merge(Data1=simplify(move.Geometry), Data2=simplify(addition), Data3=simplify(merge_2))
group_2 = Group(Objects=merge_3)

loop_end = LoopEnd(port=loop_start.port, Exit=Toggle(False), Data=group_2, pausedState=False, state="Constant output", TimeOutVal=0)

# ---- group: GENERATING TRAIL FROM RECORDED HISTORY
ungroup_2 = Ungroup(Group=loop_end)  # -> simplify(Objects)

# ----
split_2 = SplitList(List=ungroup_2, Index=Slider(2, range=0..10))  # -> ListA, ListB

# ---- group: GENERATING TRAIL FROM RECORDED HISTORY (continued)
pline_2 = PolyLine(Vertices=split_2.ListB, Closed=False)

# ----
preview = CustomPreview(Geometry=pline_2, Shader=ColourSwatch(SwatchColor=RGB(46, 170, 219)))

disc = Discontinuity(Curve=pline_2, Level=1)  # -> Points, Parameters; disabled
pline_3 = PolyLine(Vertices=disc.Points, Closed=False)  # -> flatten(Polyline); disabled

number_slider_3 = Slider(0.2, range=0..1)  # disabled
number_slider_4 = Slider(3, range=0..10)  # disabled
number_slider_5 = Slider(1, range=0..30)  # disabled
mpipe_2 = MeshPipe(Curve=pline_3, Radius=number_slider_3, Accuracy=0.2, Rotation=0, Segments=number_slider_4, Caps=number_slider_5)  # disabled

# ---- group: MESHING TRAIL / CLEAN MESH
mjoin = MeshJoin(Meshes=flatten(mpipe_2))  # disabled
wbjoin_2 = WeaverbirdsJoinMeshesAndWeld(Mesh=mjoin, Weld=False)  # disabled
