# Grasshopper definition 160707_GSS_AR1_NDVI.gh (Grasshopper 0.9.76)
# plug-ins: ProvingGround.Conduit, MeshEdit Components, RasterGrid, NDVIColorRange, NDVICalculator, ReadRasterData, gHowl, HDTReference

path = FilePath("C:\Users\User\Desktop\160707_GSS_BCN_AR\160707_GSS_BCN_AR1_NDVI\CR_LogFile.log.txt")  # disabled
panel = Panel("READ LOG FILE")  # disabled
file = ReadFile(File=path, PerLineParse=True)  # disabled
panel_2 = Panel("POS,*")  # disabled
tmatch = MatchText(Text=file, Pattern=panel_2, Case=True)  # disabled
cull = CullPattern(List=file, CullPattern=tmatch)  # -> graft(List); disabled
panel_3 = Panel(",")  # disabled
split = TextSplit(Text=cull, Separators=panel_3)  # disabled

toggle = BooleanToggle(True)  # disabled
# DATA VISUALIZATION
panel_4 = Panel("READ ORTHOMOSAIC")  # disabled
path_2 = FilePath("C:\Users\User\Desktop\160707_GSS_BCN_AR\160707_GSS_BCN_AR1_NDVI\NDVI_Orthomosaic.jpg")  # disabled
# EXTRACTING PHOTOSYNTHESIS INDEX
panel_5 = Panel(path_2)  # disabled
raster = ReadRaster(ImagePath=path_2, RunRaster=toggle)  # -> XYSize, ImageDriver, BANDs, Metadata, R, G, B; disabled
ndvical = NDVICalculator(NIR=raster.R, VIS=raster.B)  # disabled
grid = RasterGrid(XYSize=raster.XYSize)  # disabled

panel_6 = Panel(",")  # disabled
split_2 = TextSplit(Text=raster.XYSize, Separators=panel_6)  # disabled
item = ListItem(List=split_2, Index=0, Wrap=True)  # -> Item, Item1; disabled

# ---- group: WHITE BALANCE REGULATION
panel_7 = Panel("-3.5")  # disabled
multiplication = Multiplication(A=ndvical, B=panel_7)  # disabled

# ----
latitude = Slider(2, range=0..10)  # disabled
longitude = Slider(3, range=0..10)  # disabled
longitude_2 = Slider(5, range=0..10)  # disabled
item_2 = ListItem(List=split, Index=latitude, Wrap=True)  # -> flatten(Item); disabled
item_3 = ListItem(List=split, Index=longitude, Wrap=True)  # -> flatten(Item); disabled
item_4 = ListItem(List=split, Index=longitude_2, Wrap=True)  # -> flatten(Item); disabled
pt = ConstructPoint(XCoordinate=item_3, YCoordinate=item_2, ZCoordinate=item_4)  # disabled

# ----
# VISUALIZE NDVI RESULT AS HEIGHT MAP
number_slider = Slider(0, range=0..10)  # disabled
number_slider_2 = Slider(60, range=0..100)  # disabled
bnd = Bounds(Numbers=multiplication)  # disabled
dom = ConstructDomain(DomainStart=number_slider, DomainEnd=number_slider_2)  # disabled
pdecon = Deconstruct(Point=grid)  # -> XComponent, YComponent, ZComponent; disabled
remap = RemapNumbers(Value=multiplication, Source=bnd, Target=dom)  # -> Mapped, Clipped; disabled
pt_2 = ConstructPoint(XCoordinate=pdecon.XComponent, YCoordinate=pdecon.YComponent, ZCoordinate=remap.Mapped)  # disabled

swatch = ColourSwatch(SwatchColor=RGB(255, 255, 255))  # disabled

number_slider_3 = Slider(0.05, range=0..1)  # disabled
number_slider_4 = Slider(1.45, range=0..100)  # disabled
number_slider_5 = Slider(1.55, range=0..100)  # disabled
number_slider_6 = Slider(1.25, range=0..100)  # disabled
panel_8 = Panel("ISOCP")  # disabled
pie_style = ConduitPieStyle(
    InnerRadius=number_slider_6,
    OuterRadius=number_slider_4,
    LabelRadius=number_slider_5,
    LabelFontFace=panel_8,
    RelativeLabelHeight=number_slider_3,
    LabelColor=swatch)  # disabled

swatch_2 = ColourSwatch(SwatchColor=RGB(191, 0, 0))  # disabled
swatch_3 = ColourSwatch(SwatchColor=RGB(191, 191, 0))  # disabled
swatch_4 = ColourSwatch(SwatchColor=RGB(0, 191, 191))  # disabled
swatch_5 = ColourSwatch(SwatchColor=RGB(0, 191, 0))  # disabled
palette = ConduitColorPalette(
    Seed=3,
    HueRange=Domain(-0.05, 0.05),
    SaturationRange=Domain(-0.15, 0.15),
    LuminanceRange=Domain(-0.1, 0.1),
    BaseColors=[swatch_2, swatch_3, swatch_4, swatch_5])  # disabled

swatch_6 = ColourSwatch(SwatchColor=RGB(255, 0, 0))  # disabled
swatch_7 = ColourSwatch(SwatchColor=RGB(38, 255, 0))  # disabled
swatch_8 = ColourSwatch(SwatchColor=RGB(0, 42, 255))  # disabled
palette_2 = ConduitColorPalette(
    Seed=3,
    HueRange=Domain(-0.05, 0.05),
    SaturationRange=Domain(-0.15, 0.15),
    LuminanceRange=Domain(-0.1, 0.1),
    BaseColors=[swatch_6, swatch_7, swatch_8])  # disabled

panel_9 = Panel("""PIE CHART | VEGETATION PROPORTION

[INORGANIC]COLOR_0,100,75 =  25.67
[LOW REFLECTED RADIATION] COLOR_60,100,75 = 37.7
[MEDIUM REFLECTED RADIATION] COLOR_180,100,75 = 56.66
[HIGH REFLECTED RADIATION] COLOR_120,100,75 = 52.01""")  # disabled
panel_10 = Panel("""HISTOGRAM | NGB BANDS
PIXELS: 3352680
PERCENTILE: 597
STV DEV: 35.11""")  # disabled
number_slider_7 = Slider(0, range=0..2)  # disabled
number_slider_8 = Slider(2, range=0..10)  # disabled
_0_top_to_bottom_1_bottom_to_top = Slider(0, range=0..1)  # disabled
panel_11 = Panel("ISOCP")  # disabled
_0_top_to_bottom_1_bottom_to_top_2 = Slider(0, range=0..1)  # disabled
panel_12 = Panel("white")  # disabled
font = ConduitFont(
    Font=panel_11,
    TextHeight=number_slider_8,
    AdaptiveHeight=True,
    TextSpacing=1.15,
    Alignment=number_slider_7,
    Bold=False,
    Italic=False,
    Color=panel_12)  # disabled
crv = Curve(<curve referenced from the Rhino model>)  # disabled
crv_2 = Curve(<curve referenced from the Rhino model>)  # disabled
hud_text = DrawTextTest(
    Boundary=crv,
    Text=panel_9,
    TextOrdering=_0_top_to_bottom_1_bottom_to_top,
    TextDistribution=0,
    OrientVertically=False,
    CustomFont=font)  # disabled
hud_text_2 = DrawTextTest(
    Boundary=crv_2,
    Text=panel_10,
    TextOrdering=_0_top_to_bottom_1_bottom_to_top_2,
    TextDistribution=0,
    OrientVertically=False,
    CustomFont=font)  # disabled

# ---- group: NDVI CALCULATION
ndvicolor = NDVIColorRange(NDVI=multiplication)  # disabled
number_slider_9 = Slider(0.5, range=0..1)  # disabled
cloud = CloudDisplay(Points=grid, Colours=ndvicolor, Size=number_slider_9, SpriteType=0)  # disabled

# ---- group: PIN POINT 1
pt_3 = Point(<point referenced from the Rhino model>)  # disabled

# ---- group: PIN POINT 2
pt_4 = Point(<point referenced from the Rhino model>)  # disabled

# ----
# GEOREFERENCING DRONE PATH
panel_13 = Panel(path)  # disabled
panel_14 = Panel(split)  # disabled
p1_lon_lat = Panel("{-83.587934,10.148902,0}")  # disabled
p2_lon_lat = Panel("{-83.584286,10.151028,0}")  # disabled
geo_xyz = GeoToXYZ(Geo_IN=pt, Pt1ReferenceXYZ=pt_3, Pt2ReferenceXYZ=pt_4, Pt1ReferenceGeo=p1_lon_lat, Pt2ReferenceGeo=p2_lon_lat)  # disabled
pictures_amount = Slider(165, range=0..1000)  # disabled
pline = PolyLine(Vertices=geo_xyz, Closed=False)  # disabled
divide = DivideCurve(Curve=pline, Count=pictures_amount, Kinks=False)  # -> Points, Tangents, Parameters; disabled
number_slider_10 = Slider(31, range=1..165)  # disabled
split_3 = SplitList(List=divide.Points, Index=number_slider_10)  # -> ListA, ListB; disabled
swatch_9 = ColourSwatch(SwatchColor=RGB(0, 255, 238))  # disabled
number_slider_11 = Slider(0.75, range=0..2)  # disabled
number_slider_12 = Slider(0.8, range=0..50)  # disabled
swatch_10 = ColourSwatch(SwatchColor=RGB(255, 255, 255))  # disabled
swatch_11 = ColourSwatch(SwatchColor=RGB(255, 255, 255))  # disabled
number_slider_13 = Slider(1, range=0..50)  # disabled
previewlw = CustomPreviewLineweights(Geometry=pline, Shader=swatch_10, Thickness=number_slider_13)  # disabled
cloud_2 = CloudDisplay(Points=split_3.ListA, Colours=swatch_9, Size=number_slider_11, SpriteType=1)  # disabled
cloud_3 = CloudDisplay(Points=split_3.ListB, Colours=swatch_11, Size=number_slider_12, SpriteType=1)  # disabled

genes = GenePool(Decimals=2, Maximum=100, Minimum=0, Value=[25.67, 37.7, 56.66, 52.01])  # disabled
crv_3 = Curve(<curve referenced from the Rhino model>)  # disabled
hud_pie = DrawPieChart(BoundaryRectangle=crv_3, Labels=genes, DataValues=genes, PieStyle=pie_style, ColorPalette=palette)  # disabled

number_slider_14 = Slider(1, range=0..2)  # disabled
button = Button()  # disabled
pt_5 = Point(Point(-362.5002401, 351.0284524, 0))  # disabled
bounds = GetViewportBoundaryDimensions(Refresh=button, Origin=pt_5, Scale=number_slider_14, xDim=961, yDim=456)  # disabled

# ---- group: OVERLAP WITH GOOGLE EARTH
number_slider_15 = Slider(215, range=0..1000)  # disabled
number_slider_16 = Slider(138, range=0..1000)  # disabled
avr = Average(Input=pt_2)  # disabled
frompoints = MeshFromPoints(Points=pt_2, UDirection=item.Item, VDirection=item.Item1, Colour=ndvicolor)  # disabled
number_slider_17 = Slider(0.48, range=0..1)  # disabled
pt_6 = ConstructPoint(XCoordinate=number_slider_15, YCoordinate=number_slider_16, ZCoordinate=0)  # disabled
scale = Scale(Geometry=frompoints, Center=avr, Factor=number_slider_17)  # -> Geometry, Transform; disabled
vec2pt = Vector2Pt(PointA=avr, PointB=pt_6, Unitize=False)  # -> Vector, Length; disabled
move = Move(Geometry=scale.Geometry, Motion=vec2pt.Vector)  # -> Geometry, Transform; disabled

# ----
mesh = Mesh(move.Geometry)  # disabled

number_slider_18 = Slider(100, range=0..100)  # disabled
toggle_2 = BooleanToggle(True)  # disabled

num = Number(raster.R)  # disabled
number_slider_19 = Slider(5, range=0..10)  # disabled
number_slider_20 = Slider(1000, range=0..5500)  # disabled
histo = HistogramMaker(data=num, divs=number_slider_18)  # -> out, A; inputs data: list, divs: Int32; disabled
# ---------- histo: C# ----------
    //find min and max of each

    double minsofar = Convert.ToDouble(data[0]);
    double maxsofar = Convert.ToDouble(data[0]);

    foreach (object xx in data)
    {
      minsofar = Math.Min(minsofar, Convert.ToDouble(xx));
      maxsofar = Math.Max(maxsofar, Convert.ToDouble(xx));
    }

    //assign each value a category, 0 being the lowest group, 100 being the highest
    int[] cats = new int[divs + 1];
    for (int i = 0; i < cats.Length; i++) cats[i] = 0;

    for (int i = 0; i < data.Count; i++)
    {
      double cat = divs * ((Convert.ToDouble(data[i]) - minsofar) / (maxsofar - minsofar));
      cats[(int) cat]++;
    }

    A = cats;
# ---------- end histo ----------
number_slider_21 = Slider(115, range=0..1000)  # disabled
bnd_2 = Bounds(Numbers=histo.A)  # disabled
dom_2 = ConstructDomain(DomainStart=number_slider_19, DomainEnd=number_slider_20)  # disabled
remap_2 = RemapNumbers(Value=histo.A, Source=bnd_2, Target=dom_2)  # -> Mapped, Clipped; disabled
larger = LargerThan(FirstNumber=remap_2.Mapped, SecondNumber=number_slider_21)  # -> LargerThan, OrEqualTo; disabled
cull_2 = CullPattern(List=remap_2.Mapped, CullPattern=larger.LargerThan)  # disabled
index = ItemIndex(List=remap_2.Mapped, Item=cull_2)  # disabled
replace = ReplaceItems(List=remap_2.Mapped, Item=number_slider_21, Indices=index, Wrap=False)  # disabled

num_2 = Number(raster.G)  # disabled
number_slider_22 = Slider(1000, range=0..5500)  # disabled
number_slider_23 = Slider(5, range=0..10)  # disabled
histo_2 = HistogramMaker(data=num_2, divs=number_slider_18)  # -> out, A; inputs data: list, divs: Int32; disabled; same code as histo
number_slider_24 = Slider(115, range=0..1000)  # disabled
dom_3 = ConstructDomain(DomainStart=number_slider_23, DomainEnd=number_slider_22)  # disabled
bnd_3 = Bounds(Numbers=histo_2.A)  # disabled
remap_3 = RemapNumbers(Value=histo_2.A, Source=bnd_3, Target=dom_3)  # -> Mapped, Clipped; disabled
larger_2 = LargerThan(FirstNumber=remap_3.Mapped, SecondNumber=number_slider_24)  # -> LargerThan, OrEqualTo; disabled
cull_3 = CullPattern(List=remap_3.Mapped, CullPattern=larger_2.LargerThan)  # disabled
index_2 = ItemIndex(List=remap_3.Mapped, Item=cull_3)  # disabled
replace_2 = ReplaceItems(List=remap_3.Mapped, Item=number_slider_24, Indices=index_2, Wrap=False)  # disabled

num_3 = Number(raster.B)  # disabled
number_slider_25 = Slider(1000, range=0..5500)  # disabled
number_slider_26 = Slider(5, range=0..10)  # disabled
number_slider_27 = Slider(115, range=0..1000)  # disabled
histo_3 = HistogramMaker(data=num_3, divs=number_slider_18)  # -> out, A; inputs data: list, divs: Int32; disabled; same code as histo
dom_4 = ConstructDomain(DomainStart=number_slider_26, DomainEnd=number_slider_25)  # disabled
bnd_4 = Bounds(Numbers=histo_3.A)  # disabled
remap_4 = RemapNumbers(Value=histo_3.A, Source=bnd_4, Target=dom_4)  # -> Mapped, Clipped; disabled
larger_3 = LargerThan(FirstNumber=remap_4.Mapped, SecondNumber=number_slider_27)  # -> LargerThan, OrEqualTo; disabled
cull_4 = CullPattern(List=remap_4.Mapped, CullPattern=larger_3.LargerThan)  # disabled
index_3 = ItemIndex(List=remap_4.Mapped, Item=cull_4)  # disabled
replace_3 = ReplaceItems(List=remap_4.Mapped, Item=number_slider_27, Indices=index_3, Wrap=False)  # disabled

entwine = Entwine(Branch00=replace, Branch01=replace_2, Branch02=replace_3, FlattenInputs=True)  # -> simplify(Result); disabled
crv_4 = Curve(<curve referenced from the Rhino model>)  # disabled
panel_15 = Panel("0 to 100")  # disabled

# ----
# You can specify the line weights for each series
number_slider_28 = Slider(1, range=1..5)  # disabled
number_slider_29 = Slider(0, range=0..2)  # disabled
number_slider_30 = Slider(2, range=1..5)  # disabled
tstat = TreeStatistics(Tree=entwine)  # -> Paths, Length, Count; disabled
lng = ListLength(List=tstat.Paths)  # disabled
repeat = RepeatData(Data=number_slider_28, Length=lng)  # disabled
replace_4 = ReplaceItems(List=repeat, Item=number_slider_30, Indices=number_slider_29, Wrap=False)  # disabled

hud_chart = DrawChart(
    Boundary=crv_4,
    Data=entwine,
    ValueAxisRange=panel_15,
    AxisPadding=0.1,
    CategoryPadding=0.1,
    CategorySpacing=0.2,
    LineWeight=number_slider_30,
    ColorPalette=palette_2,
    IsBar=False,
    IsColumn=False,
    IsLine=True)  # disabled

merge = Merge(Data1=hud_pie, Data2=hud_text, Data3=hud_text_2, Data4=hud_chart)  # -> flatten(Result); disabled
hud = HeadsUpDisplayHUD(
    ShowHUD=toggle_2,
    DrawingObjects=merge,
    DrawingBoundary=bounds,
    ConduitStyleSheet="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")  # disabled
