# Grasshopper definition 160707_GSS_AR2_SCK.gh (Grasshopper 0.9.76)
# plug-ins: gHowl, HDTReference, Weaverbird, Mesh Pipe

path = FilePath("C:\Users\User\Desktop\160707_GSS_BCN_AR\160707_GSS_BCN_AR2_SCK\CR_LogFile.log.txt")  # disabled
panel = Panel("READ LOG FILE")  # disabled
file = ReadFile(File=path, PerLineParse=True)  # disabled
panel_2 = Panel("POS,*")  # disabled
tmatch = MatchText(Text=file, Pattern=panel_2, Case=True)  # disabled
cull = CullPattern(List=file, CullPattern=tmatch)  # -> graft(List); disabled
panel_3 = Panel(",")  # disabled
split = TextSplit(Text=cull, Separators=panel_3)  # disabled

latitude = Slider(2, range=0..10)  # disabled
longitude = Slider(3, range=0..10)  # disabled
longitude_2 = Slider(5, range=0..10)  # disabled
item = ListItem(List=split, Index=latitude, Wrap=True)  # -> flatten(Item); disabled
item_2 = ListItem(List=split, Index=longitude, Wrap=True)  # -> flatten(Item); disabled
item_3 = ListItem(List=split, Index=longitude_2, Wrap=True)  # -> flatten(Item); disabled
pt = ConstructPoint(XCoordinate=item_2, YCoordinate=item, ZCoordinate=item_3)  # disabled

# ---- group: PIN POINT 1
pt_2 = Point(<point referenced from the Rhino model>)  # disabled

# ---- group: PIN POINT 2
pt_3 = Point(<point referenced from the Rhino model>)  # disabled

# ----
# GEOREFERENCING DRONE PATH
panel_4 = Panel(path)  # disabled
panel_5 = Panel(split)  # disabled
p1_lon_lat = Panel("{-83.587934,10.148902,0}")  # disabled
p2_lon_lat = Panel("{-83.584286,10.151028,0}")  # disabled
geo_xyz = GeoToXYZ(Geo_IN=pt, Pt1ReferenceXYZ=pt_2, Pt2ReferenceXYZ=pt_3, Pt1ReferenceGeo=p1_lon_lat, Pt2ReferenceGeo=p2_lon_lat)  # disabled
pictures_amount = Slider(165, range=0..1000)  # disabled
pline = PolyLine(Vertices=geo_xyz, Closed=False)  # disabled
divide = DivideCurve(Curve=pline, Count=pictures_amount, Kinks=False)  # -> Points, Tangents, Parameters; disabled
number_slider = Slider(31, range=1..165)  # disabled
split_2 = SplitList(List=divide.Points, Index=number_slider)  # -> ListA, ListB; disabled
swatch = ColourSwatch(SwatchColor=RGB(0, 255, 238))  # disabled
number_slider_2 = Slider(0.75, range=0..2)  # disabled
number_slider_3 = Slider(0.8, range=0..50)  # disabled
swatch_2 = ColourSwatch(SwatchColor=RGB(255, 255, 255))  # disabled
swatch_3 = ColourSwatch(SwatchColor=RGB(255, 255, 255))  # disabled
number_slider_4 = Slider(1, range=0..50)  # disabled
previewlw = CustomPreviewLineweights(Geometry=pline, Shader=swatch_2, Thickness=number_slider_4)  # disabled
cloud = CloudDisplay(Points=split_2.ListA, Colours=swatch, Size=number_slider_2, SpriteType=1)  # disabled
cloud_2 = CloudDisplay(Points=split_2.ListB, Colours=swatch_3, Size=number_slider_3, SpriteType=1)  # disabled

pt_4 = Point(geo_xyz)  # disabled
pt_5 = Point(pt_4)  # disabled

# ---- group: SCK DATA
path_2 = FilePath("C:\Users\User\Desktop\160707_GSS_BCN_AR\160707_GSS_BCN_AR2_SCK\160209_SCK-post.csv")  # disabled

# ---- group: reading and formating the CVS file
file_2 = ReadFile(File=path_2, PerLineParse=True)  # disabled
panel_6 = Panel(",")  # disabled
toggle = BooleanToggle(False)  # disabled
item_4 = ListItem(List=file_2, Index=0, Wrap=True)  # disabled
shift = ShiftList(List=file_2, Shift=1, Wrap=toggle)  # disabled
split_3 = TextSplit(Text=shift, Separators=panel_6)  # disabled
split_4 = TextSplit(Text=item_4, Separators=panel_6)  # disabled

# ----
# READ SMART CITIZEN KIT DATA
panel_7 = Panel(path_2)  # disabled
panel_8 = Panel(split_4)  # disabled
item_5 = ListItem(List=split_3, Index=0, Wrap=True)  # -> Item, Item1, Item2, Item3, Item4, Item5, Item6, Item7, Item8; disabled

# ---- group: SCK TIME STAMPING
# MATCH DATA
panel_9 = Panel("2")  # disabled

# ---- group: DRONE TIME STAMPING
panel_10 = Panel("200")  # disabled

# ----
# drone = 200 millisecond
# smart Citizen kit = 2 second
panel_11 = Panel("1000")  # disabled
division = Division(A=panel_10, B=panel_11)  # disabled
division_2 = Division(A=panel_9, B=division)  # disabled
matching_factor = Panel(division_2)  # disabled

lng = ListLength(List=pt_5)  # disabled
integer_division = IntegerDivision(A=lng, B=division_2)  # disabled
panel_12 = Panel("1")  # disabled
addition = Addition(A=integer_division, B=panel_12)  # disabled
series = Series(Start=0, Step=division_2, Count=addition)  # disabled

# ---- group: keep the flight coordinate that match with temperature
pt_6 = Point(pt_5)  # disabled
lng_2 = ListLength(List=pt_6)  # disabled
division_3 = Division(A=lng_2, B=division_2)  # disabled
round = Round(Number=division_3)  # -> Nearest, Floor, Ceiling; disabled
series_2 = Series(Start=0, Step=division_2, Count=round.Ceiling)  # disabled
item_6 = ListItem(List=pt_6, Index=series_2, Wrap=True)  # disabled

# ---- group: getting the precise amount of data from the SCK
lng_3 = ListLength(List=series)  # disabled
split_5 = SplitList(List=flatten(item_5.Item), Index=lng_3)  # -> ListA, ListB; disabled

# ----
temp_value = Number(split_5.ListA)  # disabled
pt_7 = Point(item_6)  # disabled

# ---- group: generating point cloud
number_slider_5 = Slider(10, range=2..20)  # disabled
panel_13 = Panel("6")  # disabled
msphere = MeshSphere(Base=pt_7, Radius=number_slider_5, UCount=panel_13, VCount=panel_13)  # disabled

number_slider_6 = Slider(800, range=0..800)  # disabled
mjoin = MeshJoin(Meshes=msphere)  # disabled
popgeo = PopulateGeometry(Geometry=mjoin, Count=number_slider_6, Seed=1)  # -> flatten(Population); disabled

# ----
number_slider_7 = Slider(5, range=1..20)  # disabled
lng_4 = ListLength(List=msphere)  # disabled
series_3 = Series(Start=0, Step=1, Count=lng_4)  # disabled
popgeo_2 = PopulateGeometry(Geometry=msphere, Count=number_slider_7, Seed=series_3)  # -> flatten(Population); disabled

# ---- group: retrieve average temperature
neighbour_temperature = Slider(9, range=0..10)  # disabled
cps = ClosestPoints(Point=popgeo_2, Cloud=pt_7, Count=neighbour_temperature)  # -> ClosestPoint, CPIndex, Distance; disabled
item_7 = ListItem(List=temp_value, Index=cps.CPIndex, Wrap=True)  # disabled
panel_14 = Panel("1")  # disabled
division_4 = Division(A=panel_14, B=cps.Distance)  # disabled
wav = WeightedAverage(Input=item_7, Weights=division_4)  # -> flatten(ArithmeticMean); disabled
bnd = Bounds(Numbers=wav)  # disabled
dedomain = DeconstructDomain(Domain=bnd)  # -> Start, End; disabled
bar_graph = BarGraph(wav, BarColor=RGB(255, 0, 90))  # disabled
gradient = Gradient(
    LowerLimit=dedomain.Start,
    UpperLimit=dedomain.End,
    Parameter=wav,
    stops=[0: RGB(75, 107, 169), 0.249: RGB(173, 203, 249), 0.5: RGB(254, 244, 84), 0.748: RGB(234, 126, 0), 1: RGB(234, 38, 0)])  # disabled

# ---- group: FADE BY DISTANCE
pline_2 = PolyLine(Vertices=pt_5, Closed=False)  # disabled
crv_cp = CurveClosestPoint(Point=popgeo_2, Curve=pline_2)  # -> Point, Parameter, Distance; disabled

# ----
panel_15 = Panel("0")  # disabled
panel_16 = Panel("1")  # disabled
bnd_2 = Bounds(Numbers=crv_cp.Distance)  # disabled
dom = ConstructDomain(DomainStart=panel_16, DomainEnd=panel_15)  # disabled
remap = RemapNumbers(Value=crv_cp.Distance, Source=bnd_2, Target=dom)  # -> Mapped, Clipped; disabled

number_slider_8 = Slider(3, range=0..10)  # disabled
argb = SplitARGB(Colour=gradient)  # -> Alpha, Red, Green, Blue; disabled
num = Number(remap.Mapped)  # disabled
frgb = ColourRGBF(Alpha=num, Red=argb.Red, Green=argb.Green, Blue=argb.Blue)  # disabled
cloud_3 = CloudDisplay(Points=popgeo_2, Colours=frgb, Size=number_slider_8, SpriteType=0)  # disabled

swatch_4 = ColourSwatch(SwatchColor=RGB(255, 255, 255))  # disabled

bbox = BoundingBox(Content=msphere, Plane=PlaneXY(0, 0, 0), UnionBox=True)  # -> Box, Box_2; disabled
edges = BrepEdges(Brep=bbox.Box)  # -> Naked, Interior, NonManifold; disabled
item_8 = ListItem(List=edges.Interior, Index=0, Wrap=True)  # -> Item, Item1, Item2, Item3; disabled
join = JoinCurves(Curves=[item_8.Item, item_8.Item1, item_8.Item2, item_8.Item3], Preserve=False)  # disabled
panel_17 = Panel("100")  # disabled
panel_18 = Panel("0")  # disabled
number_slider_9 = Slider(1, range=0..1)  # disabled

# ---- group: build a mesh with quasi-quad face
crv = Curve(join)  # disabled
explode = Explode(Curve=crv, Recursive=True)  # -> Segments, Vertices; disabled
len = Length(Curve=explode.Segments)  # disabled
number_slider_10 = Slider(50, range=0..100)  # disabled
item_9 = ListItem(List=len, Index=0, Wrap=True)  # -> Item, Item1; disabled
division_5 = Division(A=item_9.Item, B=item_9.Item1)  # disabled
multiplication = Multiplication(A=division_5, B=number_slider_10)  # disabled
int = Integer(multiplication)  # disabled
mplane = MeshPlane(Boundary=crv, WidthCount=int, HeightCount=number_slider_10)  # -> Mesh, Area; disabled

# ---- group: humidity gradient
gradient_2 = Gradient(LowerLimit=panel_18, UpperLimit=panel_17, stops=[0.15: RGB(255, 255, 255), 0.85: RGB(0, 136, 255)])  # disabled

# ----
pdecon = Deconstruct(Point=pt_7)  # -> XComponent, YComponent, ZComponent; disabled
neighbour_temperature_2 = Slider(9, range=0..10)  # disabled
pt_8 = ConstructPoint(XCoordinate=pdecon.XComponent, YCoordinate=pdecon.YComponent, ZCoordinate=0)  # disabled

neighbour_temperature_3 = Slider(9, range=0..10)  # disabled
threshold = Slider(15, range=0..15)  # disabled
pdecon_2 = Deconstruct(Point=pt_7)  # -> XComponent, YComponent, ZComponent; disabled
demesh = DeconstructMesh(Mesh=mplane.Mesh)  # -> Vertices, Faces, Colours, Normals; disabled
pt_9 = ConstructPoint(XCoordinate=pdecon_2.XComponent, YCoordinate=pdecon_2.YComponent, ZCoordinate=0)  # disabled
cps_2 = ClosestPoints(Point=demesh.Vertices, Cloud=pt_9, Count=neighbour_temperature_3)  # -> ClosestPoint, CPIndex, simplify(Distance); disabled
smaller = SmallerThan(FirstNumber=cps_2.Distance, SecondNumber=threshold)  # -> SmallerThan, OrEqualTo; disabled
cull_2 = CullPattern(List=cps_2.CPIndex, CullPattern=smaller.SmallerThan)  # -> simplify(List); disabled
cull_3 = CullPattern(List=cps_2.Distance, CullPattern=smaller.SmallerThan)  # -> simplify(List); disabled
tstat = TreeStatistics(Tree=cull_2)  # -> Paths, Length, Count; disabled
dispatch = Dispatch(List=tstat.Paths, DispatchPattern=tstat.Length)  # -> ListA, ListB; disabled
branch = TreeBranch(Tree=cull_2, Path=dispatch.ListA, MaintainPaths=True)  # disabled
branch_2 = TreeBranch(Tree=cull_3, Path=dispatch.ListA, MaintainPaths=True)  # disabled
panel_19 = Panel("1")  # disabled
item_10 = ListItem(List=temp_value, Index=branch, Wrap=True)  # disabled
division_6 = Division(A=panel_19, B=branch_2)  # disabled
number_slider_11 = Slider(20, range=0..100)  # disabled
panel_20 = Panel("0")  # disabled
panel_21 = Panel("100")  # disabled
panel_22 = Panel("0")  # disabled
dom_2 = ConstructDomain(DomainStart=panel_22, DomainEnd=number_slider_11)  # disabled
number_slider_12 = Slider(5, range=0..10)  # disabled
panel_23 = Panel("2")  # disabled
number_slider_13 = Slider(1, range=0..1)  # disabled

lng_5 = ListLength(List=dispatch.ListB)  # disabled
panel_24 = Panel("0")  # disabled
repeat = RepeatData(Data=panel_24, Length=lng_5)  # -> simplify(graft(Data)); disabled
series_4 = Series(Start=0, Step=1, Count=lng_5)  # -> simplify(Series); disabled
path_3 = ConstructPath(Indices=graft(series_4))  # -> simplify(Branch); disabled
replace = ReplacePaths(Data=repeat, Search=flatten(path_3), Replace=simplify(dispatch.ListB))  # disabled

# ---- group: AVERAGE TEMP
wav_2 = WeightedAverage(Input=item_10, Weights=division_6)  # disabled

# ---- group: humidity gradient
gradient_3 = Gradient(LowerLimit=panel_20, UpperLimit=panel_21, stops=[0.15: RGB(255, 255, 255), 0.85: RGB(0, 136, 255)])  # disabled

# ----
demesh_2 = DeconstructMesh(Mesh=mplane.Mesh)  # -> Vertices, Faces, Colours, Normals; disabled

cps_3 = ClosestPoints(Point=demesh_2.Vertices, Cloud=pt_8, Count=neighbour_temperature_2)  # -> ClosestPoint, CPIndex, Distance; disabled
item_11 = ListItem(List=temp_value, Index=cps_3.CPIndex, Wrap=True)  # disabled

# ---- group: DEFINE A WEIGHTED AVERAGE
panel_25 = Panel("1")  # disabled
division_7 = Division(A=panel_25, B=cps_3.Distance)  # disabled
wav_3 = WeightedAverage(Input=item_11, Weights=division_7)  # -> flatten(ArithmeticMean); disabled
Z = UnitZ(Factor=wav_3)  # disabled
move = Move(Geometry=demesh_2.Vertices, Motion=Z)  # -> Geometry, Transform; disabled

# ----
number_slider_14 = Slider(3, range=0..10)  # disabled
number_slider_15 = Slider(0.001, range=0.001..1)  # disabled
pline_3 = PolyLine(Vertices=pt_8, Closed=False)  # disabled
crv_cp_2 = CurveClosestPoint(Point=demesh_2.Vertices, Curve=pline_3)  # -> Point, Parameter, Distance; disabled
bnd_3 = Bounds(Numbers=crv_cp_2.Distance)  # disabled
dom_3 = ConstructDomain(DomainStart=number_slider_14, DomainEnd=number_slider_15)  # disabled
remap_2 = RemapNumbers(Value=crv_cp_2.Distance, Source=bnd_3, Target=dom_3)  # -> Mapped, Clipped; disabled
graph = GraphMapper(
    remap_2.Mapped,
    x0=0,
    x1=5,
    y0=0,
    y1=5,
    container_name="Gaussian",
    factor=0.4511763453,
    mean=0.758838594,
    sdev=0.2188985944)  # disabled

bnd_4 = Bounds(Numbers=wav_3)  # disabled
dedomain_2 = DeconstructDomain(Domain=bnd_4)  # -> Start, End; disabled

# ---- group: temperature gradient
gradient_4 = Gradient(
    LowerLimit=dedomain_2.Start,
    UpperLimit=dedomain_2.End,
    Parameter=wav_3,
    stops=[0: RGB(75, 107, 169), 0.249: RGB(173, 203, 249), 0.5: RGB(254, 244, 84), 0.748: RGB(234, 126, 0), 1: RGB(234, 38, 0)])  # disabled

# ----
conmesh = ConstructMesh(Vertices=move.Geometry, Faces=demesh_2.Faces, Colours=gradient_4)  # disabled
wbcatmullclark = WeaverbirdsCatmullClarkSubdivision(MeshCurves=conmesh, Level=1, SmoothNakedEdges=1)  # disabled
contour = Contour(Shape=wbcatmullclark, Point=Point(0, 0, 0), Direction=Vector(0, 0, 1), Distance=number_slider_9)  # disabled
cloud_4 = CloudDisplay(Points=graft(move.Geometry), Colours=graft(gradient_4), Size=graft(graph), SpriteType=0)  # disabled

mesh = Mesh(wbcatmullclark)  # disabled
crv_2 = Curve(contour)  # disabled

previewlw_2 = CustomPreviewLineweights(Geometry=crv_2, Shader=swatch_4)  # disabled

bnd_5 = Bounds(Numbers=flatten(wav_2))  # disabled
merge = Merge(Data1=wav_2, Data2=replace)  # -> flatten(Result); disabled
dedomain_3 = DeconstructDomain(Domain=bnd_5)  # -> Start, End; disabled
bnd_6 = Bounds(Numbers=merge)  # disabled
remap_3 = RemapNumbers(Value=merge, Source=bnd_6, Target=dom_2)  # -> Mapped, Clipped; disabled
Z_2 = UnitZ(Factor=remap_3.Mapped)  # disabled
move_2 = Move(Geometry=simplify(graft(demesh.Vertices)), Motion=simplify(graft(Z_2)))  # -> Geometry, Transform; disabled
oct = OcTree(Points=flatten(move_2.Geometry), Square=True, Group=5)  # -> Boxes, Points; disabled
voxel = Voxel(Points=move_2.Geometry, X=graft(merge), Y=graft(merge), Z=graft(merge))  # disabled
wbedges = WeaverbirdsMeshEdges(MeshOrPolylines=voxel)  # disabled
geo = Geometry(oct.Boxes)  # disabled

# ---- group: temperature gradient
gradient_5 = Gradient(
    LowerLimit=dedomain_3.Start,
    UpperLimit=dedomain_3.End,
    Parameter=merge,
    stops=[0: RGB(0, 89, 255), 0.253: RGB(173, 203, 249), 0.518: RGB(254, 244, 84), 0.804: RGB(234, 126, 0), 1: RGB(234, 38, 0)])  # disabled

# ----
conmesh_2 = ConstructMesh(Vertices=flatten(move_2.Geometry), Faces=demesh.Faces, Colours=gradient_5)  # disabled
wbcatmullclark_2 = WeaverbirdsCatmullClarkSubdivision(MeshCurves=conmesh_2, Level=panel_23, SmoothNakedEdges=1)  # disabled
move_3 = Move(Geometry=wbcatmullclark_2, Motion=Vector(0, 0, 10))  # -> Geometry, Transform; disabled
contour_2 = Contour(Shape=move_3.Geometry, Point=Point(0, 0, 0), Direction=Vector(0, 0, 1), Distance=number_slider_13)  # disabled
