# Grasshopper definition POINT CLOUD.gh (Grasshopper 0.9.76)
# plug-ins: Python Interpreter, Volvox, Weaverbird

# ---- group: IMPORT E57 FILE
clo = Cloud(<cloud referenced from the Rhino model>)

# ----
rsub = RandomSubsampling(Percent=Slider(0.1, range=0..0.1), Seed=123)
cloudx = CloudEngineX(Cloud=clo, Run=Toggle(True), Abort=False, Instruction0=rsub, showinfo=True)

scale = Scale(Center=Point(0, 0, 0), Factor=Slider(10, range=0..10))  # -> Geometry, Transform
transform = Transform(Transformation=scale.Transform)

# ---- group: SETTING GRADIENTS
series = Series(Start=0, Step=1, Count=Slider(100, range=0..100))
bnd = Bounds(Numbers=series)
dedomain = DeconstructDomain(Domain=bnd)  # -> Start, End
gradient = Gradient(
    LowerLimit=dedomain.Start,
    UpperLimit=dedomain.End,
    Parameter=series,
    stops=[0.15: RGB(226, 229, 234), 0.85: RGB(152, 135, 118)])

# ----
button = Button()

# ---- group: colors collections
decloud = DeconstructCloud(Cloud=cloudx)  # -> Points, Normals, Colors
argb = SplitARGB(Colour=decloud.Colors)  # -> Alpha, Red, Green, Blue
pt = ConstructPoint(XCoordinate=argb.Red, YCoordinate=argb.Green, ZCoordinate=argb.Blue)
cloud = ConstructCloud(Points=pt, Colors=decloud.Colors)

# ----
panel = Panel(button)
cloudx_2 = CloudEngineX(Cloud=cloudx, Run=button, Abort=False, Instruction0=transform, showinfo=True)

pt_2 = ConstructPoint(XCoordinate=0, YCoordinate=0, ZCoordinate=0)
average = Average(Cloud=cloudx_2, Percent=1)
vec2pt = Vector2Pt(PointA=average, PointB=pt_2, Unitize=False)  # -> Vector, Length
move = Move(Geometry=cloudx_2, Motion=vec2pt.Vector)  # -> Geometry, Transform
transform_2 = Transform(Transformation=move.Transform)

yz = YZPlane(Origin=Point(0, 0, 0))

number_slider = Slider(43, range=0..100)
rad = Radians(Degrees=Slider(248, range=0..1000))
xz = XZPlane(Origin=Point(0, 0, 0))
rotate = Rotate(Angle=rad, Plane=yz)  # -> Geometry, Transform
transform_3 = Transform(Transformation=rotate.Transform)

argb_2 = SplitARGB(Colour=gradient)  # -> Alpha, Red, Green, Blue
pt_3 = ConstructPoint(XCoordinate=argb_2.Red, YCoordinate=argb_2.Green, ZCoordinate=argb_2.Blue)
scale_2 = Scale(Geometry=pt_3, Center=Point(0, 0, 0), Factor=Slider(255, range=0..1000))  # -> Geometry, Transform
bbox = BoundingBox(Content=scale_2.Geometry, Plane=PlaneXY(0, 0, 0), UnionBox=True)  # -> Box, Box_2

cloudx_3 = CloudEngineX(Cloud=cloudx_2, Run=Button(), Abort=False, Instruction0=transform_2, Instruction1=transform_3, showinfo=True)

box_corners = BoxCorners(Box=bbox.Box)  # -> CornerA, CornerB, CornerC, CornerD, CornerE, CornerF, CornerG, CornerH
python = PythonScript(p1=box_corners.CornerA, p2=box_corners.CornerG)  # -> out, str
# ---------- python: Python ----------
import rhinoscriptsyntax as rs

a=rs.PointCoordinates(p1)
b=rs.PointCoordinates(p2)

Xboxmin = a[0]
Yboxmin = a[1]
Zboxmin = a[2]

b=rs.PointCoordinates(p2)

Xboxmax = b[0]
Yboxmax = b[1]
Zboxmax = b[2]


str = "if ((R >= {0}) and (R <= {1}) and (G >= {2}) and (G <= {3}) and (B >= {4}) and (B <= {5}),1,0)".format(Xboxmin,Xboxmax,Yboxmin,Yboxmax,Zboxmin,Zboxmax)
print str
# ---------- end python ----------

expdata = CloudExpression(C=cloudx_3, K="somedata", E=python.str)

cullc = CullCloud(Cloud=expdata, Key="somedata", Domain="0.5 to 1")

panel_2 = Panel(expdata)

panel_3 = Panel(cullc)
panel_4 = Panel(expdata)
python_2 = PythonScript(x=panel_3, y=panel_4)  # -> out, percr
# ---------- python_2: Python ----------
import rhinoscriptsyntax as rs
import re

stringX = str(x)
stringY = str(y)
print x

Len1 = int(re.search(r'\d+', stringX).group())
Len2 = int(re.search(r'\d+', stringY).group())
print Len1, Len2

perc = (Len1*100) / Len2
percr = round(perc,2)
print percr
# ---------- end python_2 ----------
panel_5 = Panel(python_2.percr)

# ---- group: voxels
voxelc = VoxelColored(Cloud=cullc, VoxelSize=Slider(0.2, range=0..1))

# ----
wblaplace = WeaverbirdsLaplacianSmoothing(MeshCurves=voxelc, Level=Slider(3, range=0..10), SmoothNakedEdges=1, Thin=1)
wbcatmullclark = WeaverbirdsCatmullClarkSubdivision(MeshCurves=wblaplace, Level=Slider(2, range=0..10), SmoothNakedEdges=1)
