# Grasshopper definition 160715_STIGMERGY-00.gh (Grasshopper 0.9.76)
# Copyright: Co-de-iT
# plug-ins: Anemone, Boid, Weaverbird, Mesh Pipe

# ---- group: BOUNDARIES
# OPEN FIRST RHINO AND SET UNITS  IN METERS
crv = Curve(<curve referenced from the Rhino model>)

# ---- group: TRACES
pt = Point([<point referenced from the Rhino model> x9])

# ---- group: CUSTOM AGENT POSITION
crv_2 = Curve(flatten([<curve referenced from the Rhino model> x2]))

# ---- group: steering
maxforce = Slider(0.772, range=0..1)
maxspeed = Slider(2, range=0..3)

# ---- group: stigmergy
futloc = Slider(5, range=0..5)
agent = Slider(70, range=0..100)
vision_rad = Slider(25, range=0..100)
vision_ang = Slider(90, range=0..90)
follow_tail = Slider(1, range=0..1)
number_slider = Slider(40, range=0..100)

# ----
move = Move(Motion=Vector(0, 0, 10))  # -> Geometry, Transform

# ----
# COLOR MESH - GENERATE TRACES
bbox = BoundingBox(Content=crv, Plane=PlaneXY(0, 0, 0), UnionBox=True)  # -> Box, Box_2
mesh_uv = MeshSurface(Surface=bbox.Box, UCount=Slider(120, range=0..120), VCount=Slider(81, range=0..100), Overhang=True, Equalize=False)
demesh = DeconstructMesh(Mesh=mesh_uv)  # -> Vertices, Faces, Colours, Normals
pt_2 = Point(demesh.Vertices)

pull = PullPoint(Point=pt, Geometry=bbox.Box, ClosestOnly=True)  # -> ClosestPoint, Distance

cp = ClosestPoint(Point=demesh.Vertices, Cloud=pull.ClosestPoint)  # -> ClosestPoint, CPIndex, Distance
bnd = Bounds(Numbers=cp.Distance)
dedomain = DeconstructDomain(Domain=bnd)  # -> Start, End
gradient = Gradient(
    LowerLimit=dedomain.Start,
    UpperLimit=dedomain.End,
    Parameter=cp.Distance,
    stops=[0: RGB(222, 222, 222), 0.502: RGB(0, 0, 0)])
conmesh = ConstructMesh(Vertices=demesh.Vertices, Faces=demesh.Faces, Colours=gradient)
cloud = CloudDisplay(Points=graft(pt_2), Colours=graft(gradient), Size=Slider(0.5, range=0..1), SpriteType=0)  # disabled

Z = UnitZ(Factor=Slider(60, range=0..100))
move_2 = Move(Geometry=conmesh, Motion=Z)  # -> Geometry, Transform

# ----
# GENERATING AGENTS
edges = BrepEdges(Brep=bbox.Box)  # -> Naked, Interior, NonManifold
crv_3 = Curve(edges.Naked)
join = JoinCurves(Curves=crv_3, Preserve=False)

area = Area(Geometry=join)  # -> Area, Centroid
scale = Scale(Geometry=join, Center=area.Centroid, Factor=Slider(0.3, range=0..1))  # -> Geometry, Transform

demesh_2 = DeconstructMesh(Mesh=conmesh)  # -> Vertices, Faces, Colours, Normals

pop2d = Populate2D(Region=crv_2, Count=agent, Seed=2)  # -> flatten(Population)

lng = ListLength(List=pop2d)

rndvec = RandomVector(Number=lng, Unit=True, RandomSeed=2, AbsoluteMultiplier=1)
devec = DeconstructVector(Vector=rndvec)  # -> XComponent, YComponent, ZComponent
vec = VectorXYZ(XComponent=devec.XComponent, YComponent=devec.YComponent, ZComponent=devec.ZComponent)  # -> unitize(Vector), Length
merge = Merge(Data1=simplify(graft(pop2d)), Data2=simplify(graft(vec.Vector)), Data3=simplify(graft(pop2d)))
group = Group(Objects=merge)

exit = Button()
button = Button()
iterations = Slider(50, range=0..500)

loop_start = LoopStart(Repeat=iterations, Trigger=button, Data=group)  # -> port, Counter, Data

panel = Panel(loop_start.Counter)

ungroup = Ungroup(Group=loop_start.Data)  # -> simplify(Objects)
split = SplitList(List=ungroup, Index=Slider(2, range=0..10))  # -> simplify(ListA), simplify(ListB)
item = ListItem(List=split.ListA, Index=0, Wrap=True)  # -> Item, Item1

split_2 = SplitList(List=reverse(split.ListB), Index=Slider(5, range=0..10))  # -> ListA, ListB

# ----
# read environment
# future location
# brightest
# darkest
amp = Amplitude(Vector=item.Item1, Amplitude=futloc)
move_3 = Move(Geometry=item.Item, Motion=amp)  # -> Geometry, Transform
samples = Slider(5, range=3..10)
cps = ClosestPoints(Point=move_3.Geometry, Cloud=demesh_2.Vertices, Count=samples)  # -> ClosestPoint, CPIndex, Distance
item_2 = ListItem(List=demesh_2.Colours, Index=cps.CPIndex, Wrap=True)
ahsv = SplitAHSV(Colour=item_2)  # -> Alpha, Hue, Saturation, Value
sort = SortList(Keys=simplify(ahsv.Value), ValuesA=cps.ClosestPoint, ValuesB=cps.CPIndex)  # -> simplify(Keys), ValuesA, ValuesB
item_3 = ListItem(List=simplify(sort.ValuesA), Index=0, Wrap=True)  # -> Item1, Item
vec2pt = Vector2Pt(PointA=item.Item, PointB=item_3.Item, Unitize=False)  # -> Vector, Length

lng_2 = ListLength(List=split_2.ListA)
# stigmergy
vec_2 = Vector(Vector(0, 0, 0))
repeat = RepeatData(Data=vec_2, Length=lng_2)
rad = Radians(Degrees=vision_ang)
visible = FindVisibleAgents(
    AgentLocationPoint=item.Item,
    AgentMotionVector=item.Item1,
    LocationPointsOfTheFlock=flatten(split_2.ListA),
    FlockMotionVectors=flatten(repeat),
    SearchDistance=vision_rad,
    SearchAngle=rad)  # -> ListOfPoints, ListOfVectors, ListOfIndices
cluster = Cluster(
    agent_location=flatten(item.Item),
    agent_vector_global=unitize(flatten(item.Item1)),
    visible_tail=simplify(visible.ListOfPoints))  # -> graft(vector)
tail_intensity = Slider(0.486, range=0..1)
multiplication = Multiplication(A=item.Item1, B=Slider(0.3, range=0..1))
steer = Steer(vel=multiplication, des=cluster, maxv=maxspeed, maxf=follow_tail)  # -> simplify(acc)
multiplication_2 = Multiplication(A=steer, B=tail_intensity)

steer_2 = Steer(vel=item.Item1, des=vec2pt.Vector, maxv=maxspeed, maxf=maxforce)

addition = Addition(B=multiplication_2, C=steer_2)
trmvec = TrimVector(Vector=addition, LengthDomain=maxspeed)

move_4 = Move(Geometry=item.Item, Motion=trmvec)  # -> Geometry, Transform

merge_2 = Merge(Data1=simplify(split.ListB), Data2=simplify(move_4.Geometry))
merge_3 = Merge(Data1=simplify(move_4.Geometry), Data2=simplify(trmvec), Data3=simplify(merge_2))
group_2 = Group(Objects=merge_3)

loop_end = LoopEnd(port=loop_start.port, Exit=exit, Data=group_2, pausedState=False, state="Constant output", TimeOutVal=0)

dam = DataDam(DataA=loop_end, BufferDelay=10000000, BufferMode=0)
ungroup_2 = Ungroup(Group=dam)
split_3 = SplitList(List=ungroup_2, Index=Slider(2, range=0..10))  # -> ListA, ListB
nurbs = NurbsCurve(Vertices=split_3.ListB, Degree=Slider(10, range=0..10), Periodic=False)  # -> flatten(Curve), Length, Domain

reb = RebuildCurve(Curve=nurbs.Curve, Count=Slider(190, range=0..1000), Tangents=Slider(5, range=0..10))

divide = DivideCurve(Curve=reb, Count=Slider(20, range=0..100), Kinks=False)  # -> Points, Tangents, simplify(Parameters)

partition = PartitionList(List=divide.Points, Size=Slider(5, range=0..10))  # -> simplify(Chunks)
series = Series(Start=0, Step=Slider(4, range=0..10), Count=Slider(5, range=0..10))
tstat = TreeStatistics(Tree=partition)  # -> Paths, Length, Count
long = LongestList(ListA=tstat.Paths, ListB=series, PaddingMode=4)  # -> ListA, graft(ListB)
match = MatchTree(Tree=long.ListB, Guide=partition)
pdecon = Deconstruct(Point=partition)  # -> XComponent, YComponent, ZComponent
pt_3 = ConstructPoint(XCoordinate=pdecon.XComponent, YCoordinate=pdecon.YComponent, ZCoordinate=match)
pshift = ShiftPaths(Data=pt_3, Offset=-1)
intcrv = Interpolate(Vertices=pshift, Degree=3, Periodic=False, KnotStyle=1)  # -> Curve, Length, Domain
panel_2 = Panel(intcrv.Curve)
mpipe = MeshPipe(Curve=intcrv.Curve, Radius=Slider(0.3, range=0..1), Accuracy=0.2, Rotation=0, Segments=10, Caps=2)

divide_2 = DivideCurve(Curve=intcrv.Curve, Count=Slider(47, range=0..100), Kinks=False)  # -> Points, Tangents, Parameters
number_slider_2 = Slider(1, range=0..10)
voxel = Voxel(Points=flatten(divide_2.Points), X=number_slider_2, Y=number_slider_2, Z=number_slider_2)
wbcatmullclark = WeaverbirdsCatmullClarkSubdivision(MeshCurves=voxel, Level=1, SmoothNakedEdges=1)
wblaplace = WeaverbirdsLaplacianSmoothing(MeshCurves=wbcatmullclark, Level=Slider(8, range=0..10), SmoothNakedEdges=1, Thin=1)

demesh_3 = DeconstructMesh(Mesh=wblaplace)  # -> Vertices, Faces, Colours, Normals
pdecon_2 = Deconstruct(Point=demesh_3.Normals)  # -> XComponent, YComponent, ZComponent
bnd_2 = Bounds(Numbers=pdecon_2.ZComponent)
dedomain_2 = DeconstructDomain(Domain=bnd_2)  # -> Start, End
number_slider_3 = Slider(1, range=0..1)
gradient_2 = Gradient(
    LowerLimit=dedomain_2.Start,
    UpperLimit=dedomain_2.End,
    Parameter=pdecon_2.ZComponent,
    stops=[0.156: RGB(224, 198, 49), 0.388: RGB(165, 214, 28), 0.781: RGB(101, 168, 74)])
conmesh_2 = ConstructMesh(Vertices=demesh_3.Vertices, Faces=demesh_3.Faces, Colours=gradient_2)

# ==== cluster Steer
maxf = ClusterInput()
vel = ClusterInput()
maxv = ClusterInput()
des = ClusterInput()
amp = Amplitude(Vector=des, Amplitude=maxv)
subtraction = Subtraction(A=amp, B=vel)
multiplication = Multiplication(A=subtraction, B=maxf)
vlen = VectorLength(Vector=multiplication)
min = Minimum(A=vlen, B=maxv)
amp_2 = Amplitude(Vector=multiplication, Amplitude=min)
acc = ClusterOutput(amp_2)

# ==== cluster Cluster
agent_location = ClusterInput()
agent_vector_global = ClusterInput()
visible_tail = ClusterInput()
motion_vector = Vector(agent_vector_global)
# visible tail points for each agent
pt = Point(simplify(visible_tail))
pt_2 = Point(agent_location)
# get non-empty branches
clean = CleanTree(RemoveNulls=True, RemoveInvalid=True, RemoveEmpty=True, Tree=pt)  # -> simplify(Tree)
# get indices of non-empty branches
viewer = ParamViewer(clean)
dpath = DeconstructPath(Branch=viewer)  # -> flatten(Indices)
# corresponding agents for each
# non-empty branch
# corresponding velocity for each
# non-empty branch
branch = TreeBranch(Tree=simplify(graft(pt_2)), Path=viewer, MaintainPaths=True)
item = ListItem(List=motion_vector, Index=dpath, Wrap=True)
vec2pt = Vector2Pt(PointA=branch, PointB=clean, Unitize=False)  # -> Vector, Length; disabled
sort = SortList(Keys=vec2pt.Length, ValuesA=vec2pt.Vector, ValuesB=clean)  # -> Keys, ValuesA, ValuesB; disabled
# vector to closest point in tail
cp = ClosestPoint(Point=branch, Cloud=clean)  # -> ClosestPoint, CPIndex, Distance
vec2pt_2 = Vector2Pt(PointA=branch, PointB=cp.ClosestPoint, Unitize=False)  # -> Vector, Length

# ---- group: vec
item_2 = ListItem(List=sort.ValuesA, Index=0, Wrap=True)  # disabled

# ----
angle = Angle(VectorA=simplify(graft(item)), VectorB=vec2pt_2.Vector)  # -> Angle, Reflex
# angle between vectors
deg = Degrees(Radians=angle.Angle)
vlen = VectorLength(Vector=item)

# ----
# rotation axis
pl = PlaneNormal(Origin=branch, ZAxis=simplify(graft(item)))
pl_2 = PlaneNormal(Origin=branch, ZAxis=vec2pt_2.Vector)
ppx = PlanePlane(PlaneA=pl_2, PlaneB=pl)
# VERY small discrepancies
# between these two, but enough
# to make the system diverge
amp = Amplitude(Vector=vec2pt_2.Vector, Amplitude=simplify(graft(vlen)))  # -> flatten(Vector)
vrot = Rotate(Vector=simplify(graft(item)), Axis=ppx, Angle=degrees(deg))  # -> flatten(Vector)

replace = ReplaceItems(List=motion_vector, Item=vrot, Indices=dpath, Wrap=False)
vector = ClusterOutput(replace)
