# Grasshopper definition DAY_1_INTRO_GH.gh (Grasshopper 0.9.76)

number_slider = Slider(5, range=0..10)  # disabled
panel = Panel("15")  # disabled
panel_2 = Panel("100")  # disabled
number_slider_2 = Slider(4, range=1..10)  # disabled
center_box = CenterBox(Base=PlaneXY(0, 0, 0), X=number_slider, Y=panel, Z=1)  # disabled
populate_3d = Populate3D(Region=center_box, Count=panel_2, Seed=number_slider_2)  # disabled
delaunay_mesh = DelaunayMesh(Points=populate_3d, Plane=PlaneXY(0, 0, 0))  # disabled

# ---- group: EXERCISE_3 / POINT 2
number_slider_3 = Slider(10, range=0..10)  # disabled
construct_point = ConstructPoint(XCoordinate=0, YCoordinate=0, ZCoordinate=number_slider_3)  # disabled

# ---- group: EXERCISE_2 / CURVE 2 / starting points
point = Point([Point(1245.335264, -2008.146581, 0), Point(1517.186533, -539.2727862, 0), Point(2464.281278, -1179.438679, 0), Point(2503.743559, -363.8848704, 0), Point(3091.293077, -438.4247346, 0)])  # disabled

# ---- group: EXERCISE_2 / CURVE 1 / starting points
point_2 = Point([<point referenced from the Rhino model> x5])  # disabled

# ----
ciee___spring_2016 = Panel("""andrew
dakota
raquel
melissa
aria
adrienne
aaron
tricia
crystal
sara""")

# ---- group: exercise 1
number_slider_4 = Slider(3, range=1..3)  # disabled
point_3 = Point([<point referenced from the Rhino model> x5])  # disabled
point_4 = Point([Point(1245.335264, -2008.146581, 0), Point(1517.186533, -539.2727862, 0), Point(2464.281278, -1179.438679, 0), Point(2503.743559, -363.8848704, 0), Point(3091.293077, -438.4247346, 0)])  # disabled
nurbs_curve = NurbsCurve(Vertices=point_4, Degree=3, Periodic=False)  # -> Curve, Length, Domain; disabled
nurbs_curve_2 = NurbsCurve(Vertices=point_3, Degree=number_slider_4, Periodic=False)  # -> Curve, Length, Domain; disabled
flip_curve = FlipCurve(Curve=nurbs_curve.Curve)  # -> Curve, Flag; disabled
number_slider_5 = Slider(9, range=1..10)  # disabled
divide_curve = DivideCurve(Curve=flip_curve.Curve, Count=number_slider_5, Kinks=False)  # -> Points, Tangents, Parameters; disabled
divide_curve_2 = DivideCurve(Curve=nurbs_curve_2.Curve, Count=number_slider_5, Kinks=False)  # -> Points, Tangents, Parameters; disabled
line = Line(StartPoint=divide_curve_2.Points, EndPoint=divide_curve.Points)  # disabled

# ---- group: EXERCISE_2 / CURVE 1
number_slider_6 = Slider(3, range=1..3)  # disabled
nurbs_curve_3 = NurbsCurve(Vertices=point_2, Degree=number_slider_6, Periodic=False)  # -> Curve, Length, Domain; disabled

# ---- group: EXERCISE_2 / CURVE 2
nurbs_curve_4 = NurbsCurve(Vertices=point, Degree=3, Periodic=False)  # -> Curve, Length, Domain; disabled
flip_curve_2 = FlipCurve(Curve=nurbs_curve_4.Curve)  # -> Curve, Flag; disabled

# ---- group: EXERCISE_3 / POINT 1
construct_point_2 = ConstructPoint(XCoordinate=0, YCoordinate=0, ZCoordinate=0)  # disabled

# ---- group: EXERCISE_3 / POINT 3
point_5 = Point(<point referenced from the Rhino model>)  # disabled

# ---- group: EXERCISE_2 / DIVIDED CURVE
number_slider_7 = Slider(10, range=1..100)  # disabled
divide_curve_3 = DivideCurve(Curve=flip_curve_2.Curve, Count=number_slider_7, Kinks=False)  # -> Points, Tangents, Parameters; disabled
divide_curve_4 = DivideCurve(Curve=nurbs_curve_3.Curve, Count=number_slider_7, Kinks=False)  # -> Points, Tangents, Parameters; disabled

# ---- group: EXERCISE_3
line_2 = Line(StartPoint=construct_point_2, EndPoint=point_5)  # disabled
line_3 = Line(StartPoint=construct_point_2, EndPoint=construct_point)  # disabled
arc_3pt = Arc3Pt(PointA=construct_point_2, PointB=construct_point, PointC=point_5)  # -> Arc, Plane, Radius; disabled
incircle = InCircle(CornerA=construct_point_2, CornerB=construct_point, CornerC=point_5)  # -> Circle, Plane, Radius; disabled
inellipse = InEllipse(CornerA=construct_point_2, CornerB=construct_point, CornerC=point_5)  # -> Ellipse, Plane; disabled
circle_3pt = Circle3Pt(PointA=construct_point_2, PointB=construct_point, PointC=point_5)  # -> Circle, Plane, Radius; disabled
edge_surface = EdgeSurface(CurveA=line_3, CurveB=line_2)  # disabled

# ---- group: EXERCISE_2 / TANGENT 2
xz_plane = XZPlane(Origin=divide_curve_3.Points)  # disabled
deconstruct_plane = DeconstructPlane(Plane=xz_plane)  # -> Origin, XAxis, YAxis, ZAxis; disabled
reverse = Reverse(Vector=deconstruct_plane.YAxis)  # disabled

# ---- group: EXERCISE_2 / TANGET 1
xz_plane_2 = XZPlane(Origin=divide_curve_4.Points)  # disabled
deconstruct_plane_2 = DeconstructPlane(Plane=xz_plane_2)  # -> Origin, XAxis, YAxis, ZAxis; disabled

# ---- group: EXERCISE_2
biarc = BiArc(
    StartPoint=divide_curve_4.Points,
    StartTangent=deconstruct_plane_2.YAxis,
    EndPoint=divide_curve_3.Points,
    EndTangent=reverse,
    Ratio=0.5)  # -> FirstArc, SecondArc, BiArc; disabled
length = Length(Curve=biarc.BiArc)  # disabled

loft = Loft(Curves=biarc.BiArc, Options={Adjust=False, Closed=False, LoftEnds=0, LoftSimp=0, LoftType=0, Rebuild=10, Refit=0.01})  # disabled

# ---- group: EXERCISE_2 / GRADIENT COLOR
bounds = Bounds(Numbers=length)  # disabled
deconstruct_domain = DeconstructDomain(Domain=bounds)  # -> Start, End; disabled
gradient = Gradient(
    LowerLimit=deconstruct_domain.Start,
    UpperLimit=deconstruct_domain.End,
    Parameter=length,
    stops=[0: RGB(0, 128, 0), 0.5: RGB(255, 255, 0), 1: RGB(255, 0, 0)])  # disabled

# ---- group: EXERCISE_2 (continued)
custom_preview = CustomPreview(Geometry=biarc.BiArc, Shader=gradient)  # disabled
