# Grasshopper definition DAY_2_DATAVIZ.gh (Grasshopper 0.9.76)
# plug-ins: Human, gHowl

# ---- group: CHANGE ITEM TO VISUALIZE SPECIFIC DATA
number_slider = Slider(6, range=0..10)

# ----
refpt1_gps__lon_lat = Panel("{2.314918,48.843110, 0}")
refpt2_gps__lon_lat = Panel("{2.390044,48.870540,0}")
pt = Point(<point referenced from the Rhino model>)
pt_2 = Point(<point referenced from the Rhino model>)

path = FilePath("C:\Users\Utente\Google Drive\_WORK\NOUMENA\2015_NERO PROJECTS\2015_02_INTENSIF PARIS\01-DOC GRAPHIC\VECTORIAL\GH\data\csv\daily\places\places_20150921.csv")
csv_places = Panel(path)
file = ReadFile(File=csv_places, PerLineParse=True)
split = TextSplit(Text=file, Separators=",")
lon_lat = Panel("{2.354457,48.863925,0}")
lon_lat_2 = Panel("{2.323904,48.850526,0}")
pt_3 = Point(<point referenced from the Rhino model>)
pt_4 = Point(<point referenced from the Rhino model>)

tstat = TreeStatistics(Tree=split)  # -> Paths, Length, Count
shift = ShiftList(List=tstat.Paths, Shift=1, Wrap="false")
branch = TreeBranch(Tree=split, Path=shift, MaintainPaths=True)

item = ListItem(List=branch, Index="5", Wrap=True)
item_2 = ListItem(List=branch, Index="6", Wrap=True)
pt_5 = ConstructPoint(XCoordinate=item_2, YCoordinate=item, ZCoordinate=0)
geo_xyz = GeoToXYZ(Geo_IN=pt_5, Pt1ReferenceXYZ=pt_4, Pt2ReferenceXYZ=pt_3, Pt1ReferenceGeo=lon_lat, Pt2ReferenceGeo=lon_lat_2)

cir = Circle(Plane=geo_xyz, Radius=Slider(200, range=0..200))
boundary = BoundarySurfaces(Edges=cir)
preview = CustomPreview(Geometry=boundary, Shader=ColourSwatch(SwatchColor=RGBA(255, 255, 255, 89)))

path_2 = FilePath("E:\Google Drive\_WORK\NERO\2015_02_INTENSIF PARIS\01-DOC GRAPHIC\VECTORIAL\GH\data\kml\daily\activities\activities_20150921.kml")
kml_activities = Panel(path_2)
file_2 = ReadFile(File=kml_activities, PerLineParse=True)
refpt1_x_y_z = Point(pt)
refpt2_x_y_z = Point(pt_2)

kml_csv = KMLCSV(T=file_2, L=file_2)  # -> A, B
data_kml = DATAKML(T=file_2, L=file_2)

pt_6 = PointXYZ(XComponent=kml_csv.A, YComponent=kml_csv.B, ZComponent=0)
gps_xyz = GPSToXYZ(
    GPS_IN=pt_6,
    Pt1ReferenceXYZ=refpt1_x_y_z,
    Pt2ReferenceXYZ=refpt2_x_y_z,
    Pt1ReferenceGPS=refpt1_gps__lon_lat,
    Pt2ReferenceGPS=refpt2_gps__lon_lat)
pline = PolyLine(Vertices=gps_xyz, Closed=False)

panel = Panel(data_kml)

item_3 = ListItem(List=data_kml, Index=number_slider, Wrap=True)  # -> flatten(Item)
bnd = Bounds(Numbers=item_3)
dom = ConstructDomain(DomainStart=Slider(2, range=0..2), DomainEnd=Slider(8, range=0..20))
remap = RemapNumbers(Value=item_3, Source=bnd, Target=dom)  # -> Mapped, Clipped
bnd_2 = Bounds(Numbers=remap.Mapped)
dedomain = DeconstructDomain(Domain=bnd_2)  # -> Start, End
gradient = Gradient(
    LowerLimit=dedomain.Start,
    UpperLimit=dedomain.End,
    Parameter=remap.Mapped,
    stops=[0: RGB(234, 38, 0), 0.25: RGB(234, 126, 0), 0.5: RGB(254, 244, 84), 0.75: RGB(173, 203, 249), 1: RGB(75, 107, 169)])

previewlw = CustomPreviewLineweights(Geometry=flatten(pline), Shader=gradient, Thickness=remap.Mapped)

# ==== cluster KMLCSV
T = ClusterInput()
tmatch = MatchText(Text=T, Pattern="*<coordinates>*</coordinates>", Case=Toggle(False))
L = ClusterInput()
cull = CullPattern(List=L, CullPattern=tmatch)
split = StringSplit(String=cull, Separators=",")  # -> simplify(Result)
panel = Panel("""<coordinates>
</coordinates>""")
split_2 = StringSplit(String=split, Separators=panel)  # -> simplify(Result)
pshift = ShiftPaths(Data=split_2, Offset=-1)
split_3 = TextSplit(Text=pshift, Separators=" ")
pshift_2 = ShiftPaths(Data=split_3, Offset=-1)
larger = LargerThan(FirstNumber=pshift_2, SecondNumber=Slider(0, range=0..100))  # -> LargerThan, OrEqualTo
cull_2 = CullPattern(List=pshift_2, CullPattern=larger.LargerThan)  # -> simplify(List)
panel_2 = Panel("""true
false""")
panel_3 = Panel(cull_2)
dispatch = Dispatch(List=cull_2, DispatchPattern=panel_2)  # -> ListA, ListB
A = ClusterOutput(dispatch.ListA)
B = ClusterOutput(dispatch.ListB)

# ==== cluster DATAKML
T = ClusterInput()
L = ClusterInput()

tmatch = MatchText(Text=T, Pattern="*<description>*</description>", Case=Toggle(False))
cull = CullPattern(List=L, CullPattern=tmatch)
shift = ShiftList(List=cull, Shift=Slider(1, range=0..1), Wrap=Toggle(False))
split = TextSplit(Text=shift, Separators="<br/>")
item = ListItem(List=split, Index=Slider(18, range=0..100), Wrap=True)
split_2 = TextSplit(Text=item, Separators=" ")  # -> simplify(Result)

lng = ListLength(List=split_2)
smaller = SmallerThan(FirstNumber=lng, SecondNumber=Slider(9, range=0..10))  # -> SmallerThan, OrEqualTo
dispatch = Dispatch(List=split_2, DispatchPattern=smaller.SmallerThan)  # -> ListA, ListB
clean = CleanTree(RemoveNulls=True, RemoveInvalid=True, RemoveEmpty=Toggle(True), Tree=dispatch.ListA)
clean_2 = CleanTree(RemoveNulls=True, RemoveInvalid=True, RemoveEmpty=Toggle(True), Tree=dispatch.ListB)
long = LongestList(ListA=clean, ListB=clean_2, PaddingMode=2)  # -> ListA, ListB
tstat = TreeStatistics(Tree=clean)  # -> Paths, Length, Count
branch = TreeBranch(Tree=long.ListA, Path=tstat.Paths, MaintainPaths=True)
panel = Panel("""5
6
7
8""")
replace = ReplaceItems(List=branch, Item=Slider(0, range=0..100), Indices=panel, Wrap=False)
merge = Merge(Data1=simplify(replace), Data2=simplify(clean_2))
shift_2 = ShiftList(List=merge, Shift=1, Wrap=Toggle(False))  # -> simplify(List)

L_2 = ClusterOutput(shift_2)
