# Grasshopper definition DAY_2_INTRO_TREES.gh (Grasshopper 0.9.76)

series = Series(Start=0, Step=1, Count=10)  # disabled
series_2 = Series(Start=0, Step=1, Count=10)  # disabled
number_slider = Slider(5, range=0..10)  # disabled
panel = Panel(series)  # disabled
pt = ConstructPoint(XCoordinate=0, YCoordinate=series, ZCoordinate=0)  # disabled
pt_2 = ConstructPoint(XCoordinate=number_slider, YCoordinate=series_2, ZCoordinate=0)  # -> simplify(graft(Point)); disabled
ln = Line(StartPoint=pt, EndPoint=pt_2)  # -> simplify(Line); disabled
viewer = ParamViewer(pt)  # disabled
viewer_2 = ParamViewer(ln)  # disabled
viewer_3 = ParamViewer(pt_2)  # disabled
panel_2 = Panel(pt_2)  # disabled
panel_3 = Panel("{4}")  # disabled
branch = TreeBranch(Tree=ln, Path=panel_3, MaintainPaths=True)  # disabled

pt_3 = Point([Point(13, 3, 0), Point(16, 5, 0), Point(13, 7, 0), Point(14, 11, 0), Point(7, 12, 0)])  # disabled
pt_4 = Point(Point(7, 6, 0))
graft = GraftTree(Tree=pt_3, IncludeEmptyLists=True, IncludeNullItems=True)  # disabled
graft_2 = GraftTree(Tree=pt_4, IncludeEmptyLists=True, IncludeNullItems=True)
viewer_4 = ParamViewer(pt_3)  # disabled
ln_2 = Line(StartPoint=pt_4, EndPoint=graft)  # disabled
divide = DivideCurve(Curve=ln_2, Count=10, Kinks=False)  # -> simplify(Points), Tangents, Parameters; disabled
divide_2 = DivideCurve(Curve=ln_2, Count=10, Kinks=False)  # -> Points, Tangents, Parameters; disabled
panel_4 = Panel(divide.Points)  # disabled
points = PointList(Points=divide.Points, Size=Slider(1, range=0..10))

# ----
# day_2: GRAFT
# FLATTEN
# UNFLATTEN
# TREE STATISTICS
# TREE ITEM
# CHERRY PICKER
# SIMPLIFY
# SHIFT PATH
# PATH MAPPER
# TREE ITEM
# GRID_CROSS REF
# FLIP MATRIX
# RELATIVE ITEM
# RELATIVE ITEMS 2
# ///////////////////
# EXERCISES
ciee = Panel("""Aaron
Aria
Melissa
Adrienne
Patricia
Rachel
Dakota
Sarah
Andrew""")
series_3 = Series(Start=0, Step=1, Count=10)
number_slider_2 = Slider(5, range=0..10)  # disabled
crv = Curve(<curve referenced from the Rhino model>)
number_slider_3 = Slider(6, range=0..10)  # disabled
series_4 = Series(Start=0, Step=1, Count=10)
pt_5 = ConstructPoint(XCoordinate=series_3, YCoordinate=graft(series_3), ZCoordinate=0)  # -> simplify(Point)
Z = UnitZ(Factor=series_3)
eval = EvaluateCurve(Curve=reparameterize(crv), Parameter=Slider(0.5, range=0..1))  # -> Point, Tangent, Angle
series_5 = Series(Start=0, Step=1, Count=number_slider_2)  # disabled
pt_6 = ConstructPoint(XCoordinate=graft(series_4), YCoordinate=series_4, ZCoordinate=0)  # -> simplify(Point)
panel_5 = Panel(pt_6)
crossref = CrossReference(ListA=series_4, ListB=series_4, CrossMode=1)  # -> ListA, ListB
panel_6 = Panel("{1}[1]")  # disabled
graft_3 = GraftTree(Tree=pt_5, IncludeEmptyLists=True, IncludeNullItems=True)
Z_2 = UnitZ(Factor=number_slider_3)  # disabled
number_slider_4 = Slider(0.8, range=0..10)  # disabled
pt_7 = ConstructPoint(XCoordinate=crossref.ListA, YCoordinate=crossref.ListB, ZCoordinate=0)
pt_8 = ConstructPoint(XCoordinate=series_5, YCoordinate=graft(series_5), ZCoordinate=0)  # -> simplify(Point); disabled
move = Move(Geometry=graft_3, Motion=Z)  # -> simplify(Geometry), Transform
cull = CullPattern(List=ciee, CullPattern=Toggle(True))
viewer_5 = ParamViewer(pt_6)
item = ListItem(List=ciee, Index=Slider(4, range=0..10), Wrap=True)
move_2 = Move(Geometry=pt_8, Motion=Z_2)  # -> Geometry, Transform; disabled
pt_9 = ConstructPoint(XCoordinate=0, YCoordinate=0, ZCoordinate=0)
number_slider_5 = Slider(5, range=0..10)

# ---- group: FLATTEN
viewer_6 = ParamViewer(ln_2)  # disabled
flatten = FlattenTree(Tree=viewer_6, Path="{0}")  # disabled
viewer_7 = ParamViewer(flatten)  # disabled

# ---- group: SHIFT PATHS
panel_7 = Panel("-2")  # disabled
pshift = ShiftPaths(Data=divide_2.Points, Offset=panel_7)  # disabled
viewer_8 = ParamViewer(pshift)  # disabled

# ---- group: VISUALIZE THE TREE'S STRUCTURE
viewer_9 = ParamViewer(ln_2)  # disabled

# ---- group: DRAWING THE TREE
viewer_10 = ParamViewer(ln_2)  # disabled

# ----
viewer_11 = ParamViewer(pt_8)  # disabled

# ---- group: SELECT SPECIFIC ITEM IN A PATH
number_slider_6 = Slider(5, range=0..10)  # disabled
item_2 = TreeItem(Tree=divide.Points, Path="3", Index=number_slider_6, Wrap=True)

# ---- group: EXTRACT A TREE INFORMATION
tstat = TreeStatistics(Tree=ln_2)  # -> Paths, Length, Count; disabled

# ----
relitem = RelativeItem(Tree=move.Geometry, Offset="{1;1}[1]", WrapPaths=False, WrapItems=False)  # -> ItemA, ItemB
points_2 = PointList(Points=pt_8, Size=number_slider_4)  # disabled
points_3 = PointList(Points=pt_6, Size=Slider(0.8, range=0..10))
ciee_2 = Panel(cull)
relitem_2 = RelativeItem(Tree=pt_8, Offset=panel_6, WrapPaths=False, WrapItems=False)  # -> ItemA, ItemB; disabled
relitem2 = RelativeItems(TreeA=pt_8, TreeB=move_2.Geometry, Offset=panel_6, WrapPaths=False, WrapItems=False)  # -> ItemA, ItemB; disabled
pline = PolyLine(Vertices=pt_8, Closed=False)  # disabled
flatten_2 = FlattenTree(Tree=pt_6, Path="{0}")
viewer_12 = ParamViewer(move.Geometry)
series_6 = Series(Start=0, Step=number_slider_5, Count=number_slider_5)
viewer_13 = ParamViewer(flatten_2)
ln_3 = Line(StartPoint=relitem_2.ItemA, EndPoint=relitem_2.ItemB)  # disabled
ln_4 = Line(StartPoint=relitem2.ItemA, EndPoint=relitem2.ItemB)  # disabled
branch_2 = TreeBranch(Tree=move.Geometry, Path="{0;0}", MaintainPaths=True)
ln_5 = Line(StartPoint=relitem.ItemA, EndPoint=relitem.ItemB)
box = Box2Pt(PointA=relitem.ItemA, PointB=relitem.ItemB, Plane=PlaneXY(0, 0, 0))  # -> flatten(Box)
points_4 = PointList(Points=move.Geometry)
Z_3 = UnitZ(Factor=series_6)
points_5 = PointList(Points=flatten_2, Size=Slider(0.8, range=0..10))
pt_10 = ConstructPoint(XCoordinate=0, YCoordinate=0, ZCoordinate=0)
graft_4 = GraftTree(Tree=Z_3, IncludeEmptyLists=True, IncludeNullItems=True)
area = Area(Geometry=box)  # -> Area, Centroid
dist = Distance(PointA=eval.Point, PointB=area.Centroid)  # -> flatten(Distance)
move_3 = Move(Geometry=flatten_2, Motion=graft_4)  # -> Geometry, Transform
vdis = VectorDisplay(Anchor=pt_10, Vector=graft_4)
larger = LargerThan(FirstNumber=dist, SecondNumber=Slider(6.5, range=0.5..12))  # -> LargerThan, OrEqualTo

bnd = Bounds(Numbers=dist)
dom = ConstructDomain(DomainStart=Slider(0.1, range=0..1), DomainEnd=Slider(1, range=0..1))
remap = RemapNumbers(Value=dist, Source=bnd, Target=dom)  # -> Mapped, Clipped

item_3 = CherryPicker(move_3.Geometry, ListIndex=0, TreePath_path="{0;0;3}")
line = LineSDL(Start=move_3.Geometry, Direction=Vector(0, 0, 1), Length=Slider(2, range=0..10))
cull_2 = CullPattern(List=box, CullPattern=invert(larger.LargerThan))
panel_8 = Panel(larger.LargerThan)
cull_3 = CullPattern(List=box, CullPattern=larger.LargerThan)
vdis_2 = VectorDisplay(Anchor=move_3.Geometry, Vector=line)
preview = CustomPreview(Geometry=cull_2, Shader=ColourSwatch(SwatchColor=RGB(255, 255, 255)))
preview_2 = CustomPreview(
    Geometry=cull_3,
    Shader={ambient=RGB(0, 0, 0), diffuse=RGB(255, 105, 180), emission=RGB(76, 32, 54), shine=0.5, specular=RGB(255, 255, 255), transparency=0})
bnd_2 = Bounds(Numbers=dist)
scale = Scale(Geometry=box, Center=area.Centroid, Factor=remap.Mapped)  # -> Geometry, Transform
dedomain = DeconstructDomain(Domain=bnd_2)  # -> Start, End
gradient = Gradient(LowerLimit=dedomain.Start, UpperLimit=dedomain.End, Parameter=dist, stops=[0: RGB(255, 255, 255), 1: RGB(0, 0, 0)])
# VERBA VOLANT
# SCRIPTA MANENT
# 
# //////
# 
# DASHED LINE: GRAFT LIST
# 
# CONTINUOUS LINE: FLATTEN LIST
preview_3 = CustomPreview(Geometry=scale.Geometry, Shader=gradient)
