# Grasshopper definition DAY02.gh (Grasshopper 0.9.76)

# ---- group: EX_1
pt = Point(<point referenced from the Rhino model>)  # disabled
pt_2 = Point(<point referenced from the Rhino model>)  # disabled
pt_3 = Point(<point referenced from the Rhino model>)  # disabled
pt_4 = Point(<point referenced from the Rhino model>)  # disabled
pt_5 = Point(<point referenced from the Rhino model>)  # disabled
panel = Panel("20")  # disabled
cir = Circle(Plane=[pt, pt_2, pt_3, pt_4, pt_5], Radius=panel)  # disabled

# ----
pt_6 = ConstructPoint(XCoordinate=0, YCoordinate=0, ZCoordinate=0)

crv = Curve(<curve referenced from the Rhino model>)  # disabled
divide = DivideCurve(Curve=crv, Count=10, Kinks=False)  # -> Points, Tangents, Parameters; disabled
panel_2 = Panel("""true
false""")  # disabled
dispatch = Dispatch(List=divide.Points, DispatchPattern=panel_2)  # -> ListA, ListB; disabled
pt_7 = Point(dispatch.ListA)  # disabled
pt_8 = Point(dispatch.ListB)  # disabled
number_slider = Slider(3, range=0..5)  # disabled
pdecon = Deconstruct(Point=pt_7)  # -> XComponent, YComponent, ZComponent; disabled
pt_9 = ConstructPoint(XCoordinate=pdecon.XComponent, YCoordinate=pdecon.YComponent, ZCoordinate=number_slider)  # disabled
number_slider_2 = Slider(2, range=0..10)  # disabled
weave = Weave(Pattern=panel_2, Stream0=pt_8, Stream1=pt_9, NullGaps=False)  # disabled
points = PointList(Points=weave, Size=number_slider_2)  # disabled
intcrv = Interpolate(Vertices=weave, Degree=3, Periodic=False, KnotStyle=1)  # -> Curve, Length, Domain; disabled

# ---- group: BASE
number_slider_3 = Slider(20, range=0..100)  # disabled
cir_2 = Circle(Plane=PlaneXY(0, 0, 0), Radius=number_slider_3)  # disabled

# ---- group: ROOF
number_slider_4 = Slider(33, range=0..100)  # disabled
Z = UnitZ(Factor=number_slider_4)  # disabled
move = Move(Geometry=cir_2, Motion=Z)  # -> Geometry, Transform; disabled

# ----
number_slider_5 = Slider(5, range=0..10)  # disabled
series = Series(Start=0, Step=1, Count=10)  # disabled
series_2 = Series(Start=0, Step=1, Count=10)  # disabled
pt_10 = ConstructPoint(XCoordinate=number_slider_5, YCoordinate=series_2, ZCoordinate=0)  # -> simplify(graft(Point)); disabled
pt_11 = ConstructPoint(XCoordinate=0, YCoordinate=series, ZCoordinate=0)  # -> simplify(flatten(Point)); disabled
flatten = FlattenTree(Tree=pt_11, Path="{0}")  # disabled
panel_3 = Panel(pt_10)  # disabled
number_slider_6 = Slider(0.5, range=0..10)  # disabled
panel_4 = Panel(flatten)  # disabled
number_slider_7 = Slider(0.3, range=0..10)  # disabled
points_2 = PointList(Points=pt_11, Size=number_slider_6)  # disabled
viewer = ParamViewer(panel_4)  # disabled
viewer_2 = ParamViewer(panel_3)  # disabled
ln = Line(StartPoint=pt_11, EndPoint=pt_10)  # disabled
points_3 = PointList(Points=pt_10, Size=number_slider_7)  # disabled

series_3 = Series(Start=0, Step=1, Count=10)  # disabled
graft = GraftTree(Tree=series_3, IncludeEmptyLists=True, IncludeNullItems=True)  # disabled
panel_5 = Panel(series_3)  # disabled
pt_12 = ConstructPoint(XCoordinate=graft, YCoordinate=series_3, ZCoordinate=0)  # -> simplify(Point); disabled
viewer_3 = ParamViewer(pt_12)  # disabled
pline = PolyLine(Vertices=pt_12, Closed=False)  # disabled
panel_6 = Panel("{1}[1]")  # disabled
relitem = RelativeItem(Tree=pt_12, Offset=panel_6, WrapPaths=False, WrapItems=False)  # -> ItemA, ItemB; disabled
ln_2 = Line(StartPoint=relitem.ItemA, EndPoint=relitem.ItemB)  # disabled

# ---- group: SLIDERS
number_slider_8 = Slider(1, range=0..1)
number_slider_9 = Slider(10, range=0..10)
number_slider_10 = Slider(100, range=0..100)
number_slider_11 = Slider(1000, range=0..1000)

# ----
series_4 = Series(Start=0, Step=1, Count=10)
pt_13 = ConstructPoint(XCoordinate=series_4, YCoordinate=graft(series_4), ZCoordinate=0)  # -> graft(Point)
Z_2 = UnitZ(Factor=series_4)
panel_7 = Panel(pt_13)
points_4 = PointList(Points=pt_13)
move_2 = Move(Geometry=pt_13, Motion=Z_2)  # -> simplify(Geometry), Transform
item = TreeItem(Tree=move_2.Geometry, Path="{0;0}", Index=Slider(0, range=0..1), Wrap=True)
item_2 = TreeItem(Tree=move_2.Geometry, Path="{1;1}", Index=Slider(1, range=0..1), Wrap=True)
relitem_2 = RelativeItem(Tree=move_2.Geometry, Offset="{1;1}[1]", WrapPaths=False, WrapItems=False)  # -> ItemA, ItemB
box = Box2Pt(PointA=item_2, PointB=item, Plane=PlaneXY(0, 0, 0))
box_2 = Box2Pt(PointA=relitem_2.ItemA, PointB=relitem_2.ItemB, Plane=PlaneXY(0, 0, 0))  # -> flatten(Box)
viewer_4 = ParamViewer(box_2)

path = FilePath("C:\Users\Utente\Desktop\osm\map.osm")
panel_8 = Panel(path)
loc = Location(FilePText=path)  # -> OSMPointData, OSMData, LongitudeDomain, LatitudeDomain
hwy = Highways(OSMPointData=loc.OSMPointData, OSMDataText=loc.OSMData, CollectionType=0)  # -> Motorways, MotorwayLinks, Trunks, TrunkLinks, FeatureKey

genosm = GenericOSM(OSMPointData=loc.OSMPointData, OSMDataText=loc.OSMData, FeatureKey="building", FeatureValue="*", CollectionType=0)  # -> FeaturePoints, FeatureKey
pline_2 = PolyLine(Vertices=genosm.FeaturePoints, Closed=False)

# ---- group: SLIDERS
number_slider_12 = Slider(6.2, range=0..9.3)
number_slider_13 = Slider(152, range=0..152)
number_slider_14 = Slider(1, range=0..1)

# ----
number_slider_15 = Slider(26, range=0..100)  # disabled
number_slider_16 = Slider(3, range=0..10)  # disabled
divide_2 = DivideCurve(Curve=cir_2, Count=number_slider_15, Kinks=False)  # -> Points, Tangents, Parameters; disabled
divide_3 = DivideCurve(Curve=move.Geometry, Count=number_slider_15, Kinks=False)  # -> Points, Tangents, Parameters; disabled
number_slider_17 = Slider(10, range=0..10)  # disabled
points_5 = PointList(Points=divide_3.Points, Size=number_slider_16)  # disabled
number_slider_18 = Slider(3, range=0..10)  # disabled
shift = ShiftList(List=divide_2.Points, Shift=number_slider_17, Wrap=True)  # disabled
toggle = BooleanToggle(True)  # disabled
ln_3 = Line(StartPoint=shift, EndPoint=divide_3.Points)  # disabled
points_6 = PointList(Points=shift, Size=number_slider_18)  # disabled
loft_opt = LoftOptions(Closed=toggle, Adjust=False, Rebuild=0, Refit=0, Type=0)  # disabled
loft = Loft(Curves=ln_3, Options=loft_opt)  # disabled

panel_9 = Panel("6")  # disabled
panel_10 = Panel("10")  # disabled
panel_11 = Panel("TRUE")  # disabled
panel_12 = Panel("FALSE")  # disabled
panel_13 = Panel("""Tiago
Malte
Kalpesh
Agnese
Helen
Jeroen
Eva
IRO
Eleni
Matteo
Veronica
Sabrina
Anna
Pieter
YILING
Yuta
Slavica
Ekaterina
Federica
Elisabeth
Amanda
Robert
Pere
Kammil""")
dom = ConstructDomain(DomainStart=panel_9, DomainEnd=panel_10)  # disabled
panel_14 = Panel("2")  # disabled
number_slider_19 = Slider(10, range=0..10)  # disabled
lng = ListLength(List=panel_13)  # disabled
random = Random(Range=dom, Number=lng, Seed=2, Integers=True)  # disabled
panel_15 = Panel(random)
sort = SortList(Keys=random, ValuesA=panel_13)  # -> Keys, ValuesA; disabled
toggle_2 = BooleanToggle(False)  # disabled
panel_16 = Panel("5")  # disabled
division = Division(A=lng, B=panel_14)  # disabled
repeat = RepeatData(Data=panel_11, Length=division)  # disabled
repeat_2 = RepeatData(Data=panel_12, Length=division)  # disabled
panel_17 = Panel(repeat)  # disabled
panel_18 = Panel(repeat_2)  # disabled
panel_19 = Panel(sort.Keys)  # disabled
panel_20 = Panel(sort.ValuesA)  # disabled
shift_2 = ShiftList(List=panel_13, Shift=number_slider_19, Wrap=toggle_2)  # disabled
item_3 = ListItem(List=panel_13, Index=Slider(9, range=0..10), Wrap=True)  # disabled
split = SplitList(List=panel_13, Index=division)  # -> ListA, ListB; disabled
panel_21 = Panel(item_3)  # disabled
partition = PartitionList(List=panel_13, Size=panel_16)  # disabled
panel_22 = Panel(shift_2)  # disabled
merge = Merge(Data1=panel_17, Data2=panel_18)  # disabled
sort_2 = SortList()  # -> Keys, ValuesA; disabled
panel_23 = Panel(split.ListB)  # disabled
panel_24 = Panel(split.ListA)  # disabled
panel_25 = Panel(partition)  # disabled
panel_26 = Panel(merge)  # disabled
jitter = Jitter(List=panel_26, Jitter=1, Seed=2)  # -> Values, Indices; disabled
panel_27 = Panel(jitter.Values)  # disabled
dispatch_2 = Dispatch(List=panel_13, DispatchPattern=jitter.Values)  # -> ListA, ListB; disabled
panel_28 = Panel(dispatch_2.ListA)  # disabled
panel_29 = Panel(dispatch_2.ListB)  # disabled

series_5 = Series(Start=Slider(0, range=0..1), Step=1, Count="5")
panel_30 = Panel(series_5)
X = UnitX(Factor=series_5)
move_3 = Move(Geometry=pt_6, Motion=X)  # -> Geometry, Transform

X_2 = UnitX(Factor=1)  # disabled
move_4 = Move(Geometry=pt_6, Motion=X_2)  # -> Geometry, Transform; disabled
X_3 = UnitX(Factor=1)  # disabled
move_5 = Move(Geometry=move_4.Geometry, Motion=X_3)  # -> Geometry, Transform; disabled
X_4 = UnitX(Factor=1)  # disabled
move_6 = Move(Geometry=move_5.Geometry, Motion=X_4)  # -> Geometry, Transform; disabled
X_5 = UnitX(Factor=1)  # disabled
move_7 = Move(Geometry=move_6.Geometry, Motion=X_5)  # -> Geometry, Transform; disabled

majrds = MajorRoads(OSMPointData=loc.OSMPointData, OSMDataText=loc.OSMData, CollectionType=0)  # -> Primary, PrimaryLinks, Secondary, SecondaryLinks, Tertiary, FeatureKey
pline_3 = PolyLine(Vertices=majrds.Primary, Closed=False)
pline_4 = PolyLine(Vertices=majrds.Secondary, Closed=False)
pline_5 = PolyLine(Vertices=majrds.Tertiary, Closed=False)

minrds = MinorRoads(OSMPointData=loc.OSMPointData, OSMDataText=loc.OSMData, CollectionType=0)  # -> Residential, UnclassifiedRoads, NotClassified, FeatureKey
pline_6 = PolyLine(Vertices=minrds.Residential, Closed=False)
pline_7 = PolyLine(Vertices=minrds.NotClassified, Closed=False)

rail = Railways(OSMPointData=loc.OSMPointData, OSMDataText=loc.OSMData, CollectionType=0)  # -> Rail, Tram, LightRail, Subway, MonoRail, NarrowGauge, FeatureKey
pline_8 = PolyLine(Vertices=rail.Rail, Closed=False)
pline_9 = PolyLine(Vertices=rail.Tram, Closed=False)

panel_31 = Panel(ln)  # disabled

lng_2 = ListLength(List=move_3.Geometry)
panel_32 = Panel(lng_2)
dom_2 = ConstructDomain(DomainStart=Slider(0.25, range=0..1), DomainEnd=1)
random_2 = Random(Range=dom_2, Number=panel_32, Seed=Slider(4, range=0..5))
Y = UnitY(Factor=random_2)
panel_33 = Panel(random_2)
move_8 = Move(Geometry=move_3.Geometry, Motion=Y)  # -> Geometry, Transform
number_slider_20 = Slider(2, range=0..2)
item_4 = ListItem(List=move_8.Geometry, Index=number_slider_20, Wrap=True)
cull_i = CullIndex(List=move_8.Geometry, Indices=number_slider_20, Wrap=True)
number_slider_21 = Slider(0.5, range=0..1)
polygon = Polygon(Plane=item_4, Radius=number_slider_21, Segments=6, FilletRadius=0)  # -> Polygon, Length
cir_3 = Circle(Plane=cull_i, Radius=number_slider_21)

panel_34 = Panel("2")  # disabled
viewer_5 = ParamViewer(ln)  # disabled

crv_2 = Curve(<curve referenced from the Rhino model>)
eval = EvaluateCurve(Curve=reparameterize(crv_2), Parameter=Slider(0.9, range=0..1))  # -> Point, Tangent, Angle

item_5 = TreeItem(Tree=ln, Path=panel_34, Index=0, Wrap=True)  # disabled
branch = TreeBranch(Tree=ln, Path=panel_34, MaintainPaths=True)  # disabled
tstat = TreeStatistics(Tree=branch)  # -> Paths, Length, Count; disabled

area = Area(Geometry=box_2)  # -> Area, Centroid
ln_4 = Line(StartPoint=area.Centroid, EndPoint=eval.Point)
dist = Distance(PointA=eval.Point, PointB=area.Centroid)
bnd = Bounds(Numbers=dist)
dom_3 = ConstructDomain(DomainStart=Slider(0.5, range=0..1), DomainEnd=1)
remap = RemapNumbers(Value=dist, Source=bnd, Target=dom_3)  # -> Mapped, Clipped
scale = Scale(Geometry=box_2, Center=area.Centroid, Factor=remap.Mapped)  # -> Geometry, Transform

panel_35 = Panel(tstat.Count)  # disabled
panel_36 = Panel(tstat.Paths)  # disabled
panel_37 = Panel(tstat.Length)  # disabled

area_2 = Area(Geometry=scale.Geometry)  # -> Area, Centroid
bnd_2 = Bounds(Numbers=area_2.Area)
panel_38 = Panel(bnd_2)
dedomain = DeconstructDomain(Domain=bnd_2)  # -> Start, End
gradient = Gradient(
    LowerLimit=dedomain.Start,
    UpperLimit=dedomain.End,
    Parameter=area_2.Area,
    stops=[0: RGB(255, 255, 255), 1: RGB(0, 0, 0)])
preview = CustomPreview(Geometry=scale.Geometry, Shader=gradient)
