# Grasshopper definition gss_team.gh (Grasshopper 0.9.76)

group = Panel("""Tiago
Malte
Kalpesh
Agnese
Helen
Jeroen
Eva
IRO
Eleni
Matteo
Veronica
Sabrina
Anna
Pieter
YILING
Yuta
Slavica
Ekaterina
Federica
Elisabeth
Amanda
Robert
Pere
Kammil""")
graft = GraftTree(Tree=group, IncludeEmptyLists=True, IncludeNullItems=True)
bang = ExplodeTree(Data=simplify(graft))  # -> Branch0, Branch1, Branch2, Branch3, Branch4, Branch5, Branch6, Branch7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
panel = Panel(bang.Branch18)
panel_2 = Panel(bang.Branch0)
panel_3 = Panel(bang.Branch1)
panel_4 = Panel(bang.Branch2)
panel_5 = Panel(bang.Branch3)
panel_6 = Panel(bang.Branch4)
panel_7 = Panel(bang.Branch5)
panel_8 = Panel(bang.Branch6)
panel_9 = Panel(bang.Branch7)
panel_10 = Panel(bang.Branch8)
panel_11 = Panel(bang.Branch9)
panel_12 = Panel(bang.Branch10)
panel_13 = Panel(bang.Branch11)
panel_14 = Panel(bang.Branch12)
panel_15 = Panel(bang.Branch13)
panel_16 = Panel(bang.Branch14)
panel_17 = Panel(bang.Branch15)
panel_18 = Panel(bang.Branch16)
panel_19 = Panel(bang.Branch17)
panel_20 = Panel(bang.Branch19)
panel_21 = Panel(bang.Branch20)
panel_22 = Panel(bang.Branch21)
panel_23 = Panel(bang.Branch22)
panel_24 = Panel(bang.Branch23)
merge = Merge(
    Data1="True",
    Data2="True",
    Data3="True",
    Data4="False",
    Data5="False",
    Data6="False",
    Data7="False",
    Data8="False",
    Data9="False",
    Data10="True",
    Data11="False",
    Data12="False",
    Data13="True",
    Data14="True",
    Data15="False",
    Data16="False",
    Data17="True",
    Data18="True",
    Data19="False",
    Data20="False",
    Data21="False",
    Data22="False",
    Data23="False",
    Data24="True")
panel_25 = Panel("True")
gh = Panel(merge)

panel_26 = Panel("False")
jitter = Jitter(List=gh, Jitter=1, Seed=2)  # -> Values, Indices
jitter_2 = Jitter(List=group, Jitter=1, Seed=2)  # -> Values, Indices
partition = PartitionList(List=jitter_2.Values, Size=Slider(5, range=0..10))
partition_2 = PartitionList(List=jitter.Values, Size=Slider(5, range=0..10))
panel_28 = Panel(partition)
# group 1 (1 True)
# Anna T
# Robert F
# Sabrina F
# Amanda F
# Veronica F
# 
# group 2 (2 True)
# Helen F
# Kalpesh T
# Ekaserina T
# Eleni F
# Yuta F
# 
# group 3 (2 True)
# Pere F
# Jeroen F
# Matteo T
# Yiling F
# Malte T
# 
# group 4 (2 True)
# Iro F
# Pieter T
# Slavica F
# Federica F
# Kammil T
# 
# group 5 (1 True)
# Need a true, please!
# Tiago T
# Elizabeth F
# Eva F
# Agnese F
panel_29 = Panel(partition_2)
# 01-GLORIES
# 02-PARC DE LA CIUDADELLA
# 03-BESOS
# 04-AVINGUDA DE LA CATEDRAL
# 05-PARALLEL
# energy production
# food production
# augmented citizens
# data infrastructure
# urban efficiency
branch = TreeBranch(MaintainPaths=True)
